# Grasshopper definition CellPhoneStandModel_all.gh (Grasshopper 1.0.7)
# plug-ins: Human, GhPolyhedra, OpenNest

student_location_x_coordinate = Slider(0, range=-12000..12000)
student_viewpoint_z_coordinate = Slider(1350, range=0..12000)
student_location_y_coordinate = Slider(-1000, range=-12000..12000)
student_location_z_coordinate = Slider(0, range=0..12000)
student_range_width_mm = Slider(800, range=0..12000)
student_range_height_mm = Slider(1650, range=0..12000)
student_activity_range_cloud_radius_mm = Slider(410, range=0..12000)
student_activity_location_z_coordinate = Slider(1100, range=0..12000)
# notes: let us make a simple model of the context of the activity
notes = Panel("floor")
notes_2 = Panel("student")
floor_location_x_coordinate = Slider(0, range=0..300)
floor_location_y_coordinate = Slider(0, range=0..300)
floor_location_z_coordinate = Slider(0, range=0..300)
floor_width_mm = Slider(7500, range=0..12000)
floor_length_mm = Slider(7500, range=0..12000)
notes_3 = Panel("table")

# ---- group: Get System Type, Get File Path, Set Material Texture
# notes: The file for the desk texture image includes the word "desk"
system_id = GhPythonScript()  # -> out, OS
# ---------- system_id: Python ----------
__author__ = "tj"
__version__ = "2023.08.28"

import rhinoscriptsyntax as rs
import platform

system_name = platform.system()

if system_name == "Windows":
    OS = "Windows PC"
elif system_name == "Darwin":
    OS = "Mac OS"
elif system_name == "Linux":
    OS = "Linux"
else:
    OS = "Unknown Operating System"
# ---------- end system_id ----------
activedoc_path = GhPythonScript()  # -> out, a
# ---------- activedoc_path: Python ----------
__author__ = "tj"
__version__ = "2023.08.24"

import rhinoscriptsyntax as rs
from Rhino import RhinoDoc
import os

# This gets the full path to the active file
active_file_path = RhinoDoc.ActiveDoc.Path

# This gets the directory of the active file
active_file_directory = os.path.dirname(active_file_path)

if active_file_directory is None or active_file_directory == "":
    a = "The active_file_directory is null. Is this file saved?"
else:
    a = active_file_directory
# ---------- end activedoc_path ----------
panel = Panel(system_id.OS)
activedoc_path_2 = Panel(activedoc_path.a)
image_filetypes = Panel("""*.png 
*.jpg 
*.tif""")
eval = Evaluate(F="if(OS=\"Windows PC\", 0,1)", OS=panel)
filter = StreamFilter(Gate=eval, Stream0="\", Stream1="/")
directory_for_images = Text(activedoc_path_2)
filetype_filters = Text(image_filetypes)
filter_2 = StreamFilter(Gate=eval, Stream0="studentknitting_alpha.tif", Stream1="studentknitting_alpha_mac.tif")
dir = DirectoryContents(FolderPath=directory_for_images, Filter=filetype_filters, IncludeSubfolders=False)  # -> FilePaths, FileNames
panel_2 = Panel(directory_for_images)
panel_3 = Panel(filter)
panel_4 = Panel(filter_2)
image_file_paths = Text(flatten(dir.FilePaths))
concat = Concatenate(FragmentA=panel_2, FragmentB=panel_3)
panel_5 = Panel(image_file_paths)
concat_2 = Concatenate(FragmentA=concat, FragmentB="greyFloor.tif")
concat_3 = Concatenate(FragmentA=concat, FragmentB="studentknitting.tif")
concat_4 = Concatenate(FragmentA=concat, FragmentB=panel_4)
concat_5 = Concatenate(FragmentA=concat, FragmentB="deskTile.tif")
panel_6 = Panel(concat_2)
panel_7 = Panel(concat_3)
panel_8 = Panel(concat_4)
panel_9 = Panel(concat_5)

# ----
# notes: let us make a simple model our phone.
# notes: let us construct an origin point for the cell phone.
notes_4 = Panel("phone body")
phone_width_mm = Slider(81, range=0..300)
phone_length_mm = Slider(165, range=0..300)
phone_thickness = Slider(13, range=0..300)
phone_tolerance_mm = Slider(1, range=0..2)
table_location_x_coordinate = Slider(0, range=0..300)
phone_corner_radius_mm = Slider(5, range=0..300)
table_location_y_coordinate = Slider(0, range=0..300)
table_location_z_coordinate = Slider(0, range=0..300)
phone_location_x_coordinate = Slider(0, range=0..300)
table_width_mm = Slider(1000, range=0..12000)
phone_location_y_coordinate = Slider(0, range=0..300)
table_length_mm = Slider(1000, range=0..12000)
phone_location_z_coordinate = Slider(0, range=0..300)
table_height_mm = Slider(800, range=0..12000)
# notes: let us define the screen as an offset from the outside edge of the device
notes_5 = Panel("phone screen")
phone_screen_offset_from_edge_mm = Slider(4, range=0..300)
camera35mmlenslength = Slider(24, range=18..80)
# notes: let us construct an origin point for the cell phone camera relative to the origin point of the phone.
notes_6 = Panel("phone camera lens")
# notes: let us construct a representation of the field of view for the camera.
phone_lens_view_depth = Slider(3000, range=0..3000)
phone_lens_location_x_coordinate = Slider(0, range=0..300)
phone_lens_location_y_coordinate = Slider(150, range=0..300)
phone_lens_location_z_coordinate = Slider(13, range=0..300)
phone_lens_rim_offset = Slider(3, range=0..300)
phone_lens_radius = Slider(5, range=0..25)
# notes: phone camera view frustum
phone_lens_thickness = Slider(0.5, range=0..2)
pt = ConstructPoint(
    XCoordinate=student_location_x_coordinate,
    YCoordinate=student_location_y_coordinate,
    ZCoordinate=student_location_z_coordinate)
num_student_width = Number(student_range_width_mm)
num_student_height = Number(student_range_height_mm)
num_floor_length = Number(floor_length_mm)
num_floor_width = Number(floor_width_mm)
pt_student_origin = Point(pt)
pt_student_origin_2 = Point(pt_student_origin)
pt_student_origin_3 = Point(pt_student_origin)
pdecon = Deconstruct(Point=pt_student_origin_2)  # -> XComponent, YComponent, ZComponent
pdecon_2 = Deconstruct(Point=pt_student_origin_3)  # -> XComponent, YComponent, ZComponent
pt_2 = ConstructPoint(
    XCoordinate=floor_location_x_coordinate,
    YCoordinate=floor_location_y_coordinate,
    ZCoordinate=floor_location_z_coordinate)
num_student_activity_range = Number(student_activity_range_cloud_radius_mm)
num_table_length = Number(table_length_mm)
num_table_width = Number(table_width_mm)
num_table_height = Number(table_height_mm)
pt_3 = ConstructPoint(
    XCoordinate=table_location_x_coordinate,
    YCoordinate=table_location_y_coordinate,
    ZCoordinate=table_location_z_coordinate)
num_phone_width = Number(phone_width_mm)
num_phone_length = Number(phone_length_mm)
num_phone_corner_radius = Number(phone_corner_radius_mm)
num_phone_thickness = Number(phone_thickness)
num_phone_fit_tolerance = Number(phone_tolerance_mm)
# notes: This is a point that will help us conceptually connect the virtual world to the physical world.
pt_phone_origin = ConstructPoint(
    XCoordinate=phone_location_x_coordinate,
    YCoordinate=phone_location_y_coordinate,
    ZCoordinate=phone_location_z_coordinate)
pt_4 = ConstructPoint(XCoordinate=pdecon.XComponent, YCoordinate=pdecon.YComponent, ZCoordinate=student_viewpoint_z_coordinate)
pt_5 = ConstructPoint(XCoordinate=pdecon_2.XComponent, YCoordinate=pdecon_2.YComponent, ZCoordinate=student_activity_location_z_coordinate)
pt_floor_origin = Point(pt_2)
num_camera35mmlenslength = Number(camera35mmlenslength)
pt_table_origin = Point(pt_3)
pt_student_activity = Point(pt_5)
cluster = Cluster(num=num_floor_length)
cluster_2 = Cluster(num=num_floor_width)
num_screen_offset_from_edge = Number(phone_screen_offset_from_edge_mm)
pt_student_viewpoint = Point(pt_4)
xy = XYPlane(Origin=pt_floor_origin)
symmetric_domain = Cluster(num=num_student_width)
vec_lens_location = VectorXYZ(
    XComponent=phone_lens_location_x_coordinate,
    YComponent=phone_lens_location_y_coordinate,
    ZComponent=phone_lens_location_z_coordinate)  # -> Vector, Length
dom = ConstructDomain(DomainStart="0", DomainEnd=num_student_height)
xz = XZPlane(Origin=pt_student_origin)
cluster_3 = Cluster(num=num_table_length)
cluster_4 = Cluster(num=num_table_width)
xy_2 = XYPlane(Origin=pt_table_origin)
xy_3 = XYPlane(Origin=pt_student_activity)
# notes: right click on the grey box allows me to name this element.
pt_phone_origin_2 = Point(pt_phone_origin)
domain_floor_length = Domain(cluster)
domain_floor_width = Domain(cluster_2)
pln_student = Plane(xz)
domain_student_width = Domain(symmetric_domain)
domain_student_height = Domain(dom)
domain_table_length = Domain(cluster_3)
domain_table_width = Domain(cluster_4)
cluster_5 = Cluster_3(num_camera35mmlenslength=num_camera35mmlenslength)
domain_floor_width_2 = Panel(domain_floor_width)
domain_floor_length_2 = Panel(domain_floor_length)
division = Division(A=num_phone_width, B="2.0")
pln_floor = Plane(xy)
domain_student_width_2 = Panel(domain_student_width)
domain_student_height_2 = Panel(domain_student_height)
domain_table_width_2 = Panel(domain_table_width)
domain_table_length_2 = Panel(domain_table_length)
pln_table = Plane(xy_2)
# notes: a reference plane whose origin is that point
xy_4 = XYPlane(Origin=pt_phone_origin_2)
neg = Negative(Value=division)
panel_10 = Panel(division)
neg_2 = Negative(Value=num_screen_offset_from_edge)
num_fov = Number(cluster_5)
dom_2 = ConstructDomain(DomainStart=division, DomainEnd=neg)
pln_phone_origin = Plane(xy_4)
pln_phone_origin_2 = Plane(pln_phone_origin)
move = Move(Geometry=pln_phone_origin_2, Motion=vec_lens_location.Vector)  # -> Geometry, Transform
pln_phone_lens_origin = Plane(move.Geometry)
cir = Circle(Plane=pln_phone_lens_origin, Radius=phone_lens_radius)
crv_phone_lens_outline = Curve(cir)
pln_phone_lens_origin_2 = Plane(pln_phone_lens_origin)
neg_3 = Negative(Value=phone_lens_rim_offset)
rectangle = Rectangle(Plane=pln_floor, XSize=domain_floor_width, YSize=domain_floor_length, Radius=0)  # -> Rectangle, Length
Z = UnitZ(Factor=phone_lens_view_depth)
panel_11 = Panel(dom_2)
# notes: here we create a fustrum that more accurately reflects the camera view and what is seen on screen.
pln_phone_lens_origin_3 = Plane(pln_phone_lens_origin)
multiplication = Multiplication(A="9", B=num_fov)
# notes: with this we can set up a view to see what the camera will see while in the stand.  we can also test whether specific object will be in the field of view.
multiplication_2 = Multiplication(A="16", B=num_fov)
rectangle_2 = Rectangle(Plane=pln_student, XSize=domain_student_width, YSize=domain_student_height, Radius=0)  # -> Rectangle, Length
offset = OffsetCurve(Curve=crv_phone_lens_outline, Distance=neg_3, Corners=1)
divisions = Slider(2, range=0..7)
rectangle_3 = Rectangle(Plane=pln_table, XSize=domain_table_width, YSize=domain_table_length, Radius=0)  # -> Rectangle, Length
num_table_height_2 = Number(num_table_height)
multiplication_3 = Multiplication(A=phone_lens_view_depth, B=multiplication)
multiplication_4 = Multiplication(A=phone_lens_view_depth, B=multiplication_2)
boundary = BoundarySurfaces(Edges=rectangle.Rectangle)
merge = Merge(Data1=crv_phone_lens_outline, Data2=offset)  # -> flatten(Result)
boundary_2 = BoundarySurfaces(Edges=rectangle_2.Rectangle)
panel_12 = Panel(pln_phone_lens_origin_2)
move_2 = Move(Geometry=pln_phone_lens_origin_3, Motion=Z)  # -> Geometry, Transform
boundary_3 = BoundarySurfaces(Edges=rectangle_3.Rectangle)
cloud_distribution = Slider(0.5, range=0.25..3)
num_student_activity_range_2 = Number(num_student_activity_range)
cloud_point_count = Slider(1200, range=0..1200)
pt_student_activity_2 = Point(xy_3)
num_x_size = Number(multiplication_3)
srf_student = Surface(boundary_2)
num_y_size = Number(multiplication_4)
boundary_4 = BoundarySurfaces(Edges=merge)
# notes: this creates a rectangle from the input of a plane, X dimension, and Y dimension.
phone_rectangle = Rectangle(Plane=pln_phone_origin, XSize=dom_2, YSize=num_phone_length, Radius=num_phone_corner_radius)  # -> Rectangle, Length
srf_floor = Surface(boundary)
pln_phone_lens_origin_4 = Plane(move_2.Geometry)
sph = Sphere(Base=xy_3, Radius=num_student_activity_range)
icosphere = IcoSphere(Plane=xy_3, Scale=num_student_activity_range, Density=divisions)
num_phone_fit_tolerance_2 = Number(num_phone_fit_tolerance)
Z_2 = UnitZ(Factor=num_table_height_2)
srf_table = Surface(boundary_3)
division_2 = Division(A=num_x_size, B="2.0")
srf_phone_lens_outline_surface = Surface(boundary_4)
division_3 = Division(A=num_y_size, B="2.0")
num_phone_thickness_2 = Number(num_phone_thickness)
rectangle_length = Panel(phone_rectangle.Length)
neg_4 = Negative(Value=division_2)
brep_student_activity = Brep(sph)
mesh_student_activity = Mesh(icosphere)
neg_5 = Negative(Value=division_3)
Z_3 = UnitZ(Factor=phone_lens_thickness)
crv_phone_outline = Curve(phone_rectangle.Rectangle)
crv_phone_outline_2 = Curve(crv_phone_outline)
offset_2 = OffsetCurve(Curve=crv_phone_outline_2, Distance=neg_2, Corners=1)
panel_13 = Panel(offset_2)
crv = Curve(flatten(offset_2))
crv_phone_outline_3 = Curve(crv_phone_outline)
move_3 = Move(Geometry=srf_table, Motion=Z_2)  # -> Geometry, Transform
dimension_x_mm = Slider(1200, range=0..1200)
dimension_y_mm = Slider(1200, range=0..1200)
dom_3 = ConstructDomain(DomainStart=division_2, DomainEnd=neg_4)
dom_4 = ConstructDomain(DomainStart=division_3, DomainEnd=neg_5)
spherical_point_cloud = CSharpScript(
    cloud_pointcount=cloud_point_count,
    cloud_centerpoint=pt_student_activity_2,
    cloud_radius=num_student_activity_range_2,
    cloud_distribution=cloud_distribution)  # -> out, centerpoint, radius, pointcloud; inputs cloud_pointcount: Int32, cloud_centerpoint: Point3d, cloud_radius: Double, cloud_distribution: Double
# ---------- spherical_point_cloud: C# ----------
    List<Point3d> points = new List<Point3d>();
    for(int i = 0; i < cloud_pointcount;i++)
    {
      Point3d p = GenerateRandomPointInsideSphere(cloud_radius, cloud_distribution);
      p = p + cloud_centerpoint;
      points.Add(p);
    }

    radius = cloud_radius;
    pointcloud = points;
    centerpoint = (Point3d) cloud_centerpoint;
# ---------- spherical_point_cloud: C# additional code ----------
  // Rest of the code
  // using System;
  //using Rhino.Geometry;  // For Point3d

  private static Random rnd = new Random();

  private Point3d GenerateRandomPointInsideSphere(double R, double root)
  {
    // Get random values between 0 and 1
    double u = rnd.NextDouble();
    double v = rnd.NextDouble();
    double w = rnd.NextDouble();

    double theta = Math.Acos(2 * u - 1);
    double phi = 2 * Math.PI * v;
    double r = R * Math.Pow(w, 1.0 / root);

    // Convert to Cartesian coordinates
    double x = r * Math.Sin(theta) * Math.Cos(phi);
    double y = r * Math.Sin(theta) * Math.Sin(phi);
    double z = r * Math.Cos(theta);

    return new Point3d(x, y, z);
  }
# ---------- end spherical_point_cloud ----------
offset_3 = OffsetCurve(Curve=crv_phone_outline_3, Distance=num_phone_fit_tolerance_2, Corners=1)  # -> flatten(Curve)
num_x_2_0 = Number(expr("x*2.0", num_phone_fit_tolerance_2))
Z_4 = UnitZ(Factor=num_phone_fit_tolerance_2)
extr = Extrude(Base=srf_phone_lens_outline_surface, Direction=Z_3)
geo_to_preview = Geometry(srf_floor)
medges = MeshEdges(Mesh=mesh_student_activity)  # -> NakedEdges, InteriorEdges, NonManifoldEdges
srf_table_2 = Surface(move_3.Geometry)
boundary_5 = BoundarySurfaces(Edges=offset_3)
pln_phone_lens_origin_5 = Plane(pln_phone_lens_origin_2)
rev = Reverse(Vector=Z_2)
brep_phone_lens = Brep(extr)
geo_to_preview_2 = Geometry(medges.InteriorEdges)
addition = Addition(A=num_phone_thickness_2, B=num_x_2_0)
geo_to_preview_3 = Geometry(srf_student)
rectangle_4 = Rectangle(Plane=pln_phone_lens_origin_4, XSize=dom_3, YSize=dom_4, Radius=0)  # -> Rectangle, Length
srf_tolerance_phone_outline_surface = Surface(boundary_5)
rev_2 = Reverse(Vector=Z_4)
cluster_6 = Cluster(num=dimension_y_mm)
cluster_7 = Cluster(num=dimension_x_mm)
point_size = Slider(9, range=0..25)
extr_2 = ExtrudePoint(Base=rectangle_4.Rectangle, Point=pln_phone_lens_origin_3)
pln_floor_2 = Plane(pln_floor)
srf_floor_2 = Surface(srf_floor)
extr_3 = Extrude(Base=srf_table_2, Direction=rev)
srf_table_3 = Surface(srf_table_2)
cluster_8 = Cluster(num=num_student_width)
dom_5 = ConstructDomain(DomainStart="0", DomainEnd=num_student_height)
srf_student_2 = Surface(srf_student)
pln_student_2 = Plane(pln_student)
# notes: this creates a surface from the curve.  the input curve becomes the surface edge.
boundary_6 = BoundarySurfaces(Edges=crv_phone_outline)
cluster_9 = Cluster_2(
    geo_to_preview=geo_to_preview,
    col_preview_diffuse_color=ColourSwatch(SwatchColor=RGB(235, 192, 124)),
    num_preview_transparency=Slider(0, range=0..1))
pt_student_viewpoint_2 = Point(pt_student_viewpoint)
cap = CapHoles(Brep=extr_2)
Z_5 = UnitZ(Factor=addition)
planarmap = PlanarMapping(Mesh=srf_floor_2, Plane=pln_floor_2, XExtents=cluster_7, YExtents=cluster_6)  # -> MappedMesh, MappingPlane
cluster_10 = Cluster_2(
    geo_to_preview=geo_to_preview_2,
    col_preview_diffuse_color=ColourSwatch(SwatchColor=RGB(145, 209, 255)),
    num_preview_transparency=Slider(0, range=0..1))
brep_table = Brep(extr_3)
srf_phone_outline_surface = Surface(boundary_6)
cluster_11 = Cluster_2(
    geo_to_preview=geo_to_preview_3,
    col_preview_diffuse_color=ColourSwatch(SwatchColor=RGB(166, 166, 166)),
    num_preview_transparency=Slider(0, range=0..1))
num_camera35mmlenslength_2 = Number(num_camera35mmlenslength)
brep_phone_field_of_view_cone = Brep(cap)
srf_table_4 = Surface(srf_table_3)
planarmap_2 = PlanarMapping(Mesh=srf_student_2, Plane=pln_student_2, XExtents=cluster_8, YExtents=dom_5)  # -> MappedMesh, MappingPlane
move_4 = Move(Geometry=srf_tolerance_phone_outline_surface, Motion=rev_2)  # -> Geometry, Transform
txt_texture_path_student_transparency = Text(panel_8)
txt_texture_path_student = Text(panel_7)
txt_texture_path_floor = Text(panel_6)
txt_texture_path_desk = Text(panel_9)
quadsphere = QuadSphere(Plane=spherical_point_cloud.pointcloud, Scale=point_size, Density=0)
Z_6 = UnitZ(Factor=num_phone_thickness_2)
extr_4 = Extrude(Base=move_4.Geometry, Direction=Z_5)
txt_texture_path_student_transparency_2 = Text(txt_texture_path_student_transparency)
vec = Vector(Z_6)
crv_student_activity_bounds = Curve(cluster_10)
mesh_student_activity_2 = Mesh(mesh_student_activity)
brep_student_activity_2 = Brep(brep_student_activity)
extr_5 = Extrude(Base=srf_phone_outline_surface, Direction=Z_6)
srf_student_3 = Surface(cluster_11)
preview = CustomPreview(Geometry=quadsphere, Material=ColourSwatch(SwatchColor=RGB(0, 229, 255)))
txt_texture_path_student_2 = Text(txt_texture_path_student)
txt_texture_path_floor_2 = Text(txt_texture_path_floor)
txt_texture_path_floor_3 = Text(txt_texture_path_floor_2)
txt_texture_path_desk_2 = Text(txt_texture_path_desk)
move_5 = Move(Geometry=crv, Motion=vec)  # -> Geometry, Transform
previewmat = CustomPreviewMaterials(Geometry=planarmap.MappedMesh, DiffuseColor=RGB(255, 255, 255), DiffuseBitmap=txt_texture_path_floor_3)
brep_phone = Brep(extr_5)
num_camera35mmlenslength_3 = Number(num_camera35mmlenslength_2)
brep_phone_field_of_view_cone_2 = Brep(brep_phone_field_of_view_cone)
txt_texture_path_student_transparency_3 = Text(txt_texture_path_student_transparency_2)
srf_phone_outline_surface_2 = Surface(boundary_6)
brep_tolerance_phone = Brep(extr_4)
pln_phone_lens_origin_6 = Plane(pln_phone_lens_origin_5)
crv_phone_outline_4 = Curve(phone_rectangle.Rectangle)
crv_phone_screen = Curve(move_5.Geometry)
pln_phone_origin_3 = Plane(xy_4)
brep_phone_lens_2 = Brep(brep_phone_lens)
txt_texture_path_student_3 = Text(txt_texture_path_student_2)
brep_phone_2 = Brep(brep_phone)
merge_phone_components = Merge(
    Data1=pln_phone_origin_3,
    Data2=crv_phone_outline_4,
    Data3=srf_phone_outline_surface_2,
    Data4=brep_phone_2,
    Data5=brep_phone_lens_2,
    Data6=pln_phone_lens_origin_6,
    Data7=brep_phone_field_of_view_cone_2,
    Data8=crv_phone_screen,
    Data9=brep_tolerance_phone)
previewmat_2 = CustomPreviewMaterials(
    Geometry=planarmap_2.MappedMesh,
    DiffuseColor=RGB(255, 255, 255),
    DiffuseBitmap=txt_texture_path_student_3,
    TransparencyBitmap=txt_texture_path_student_transparency_3)
map_dimension_mm = Slider(100, range=0..12000)
geo_to_preview_4 = Geometry(brep_table)
num_map_dimension = Number(map_dimension_mm)
table_x_coordinate = Slider(500, range=0..1000)
table_y_coordinate = Slider(500, range=0..1000)
srf_table_5 = Surface(srf_table_4)
geo_phone_components = Geometry(merge_phone_components)
cluster_12 = Cluster(num=num_map_dimension)
cluster_13 = Cluster_2(
    geo_to_preview=geo_to_preview_4,
    col_preview_diffuse_color=ColourSwatch(SwatchColor=RGB(209, 180, 134)),
    num_preview_transparency=Slider(0, range=0..1))
pt_6 = ConstructPoint(XCoordinate=table_x_coordinate, YCoordinate=table_y_coordinate, ZCoordinate=0)
brep_table_2 = Brep(brep_table)
box = CenterBox(Base=PlaneXY(0, 0, 0), X=cluster_12, Y=cluster_12, Z=cluster_12)
evalsrf = EvaluateSurface(Surface=srf_table_5, Point=pt_6)  # -> Point, Normal, UDirection, VDirection, Frame
pln_phone_location_on_table = Plane(evalsrf.Frame)
brep_table_3 = Brep(cluster_13)
brep_table_4 = Brep(brep_table_2)
item = ListItem(List=geo_phone_components, Index="0", Wrap=True)
boxmap = BoxMapping(Mesh=brep_table_2, Box=box)
txt_texture_path_desk_3 = Text(txt_texture_path_desk_2)
pt_phone_location_on_table = Point(pln_phone_location_on_table)
pln_phone_origin_4 = Plane(item)
previewmat_3 = CustomPreviewMaterials(Geometry=boxmap, DiffuseColor=RGB(255, 255, 255), DiffuseBitmap=txt_texture_path_desk_3)
pt_student_viewpoint_3 = Point(pt_student_viewpoint_2)
mesh_student_activity_3 = Mesh(mesh_student_activity_2)
brep_student_activity_3 = Brep(brep_student_activity_2)
vec2pt = Vector2Pt(PointA=pln_phone_origin_4, PointB=pt_phone_location_on_table, Unitize=False)  # -> Vector, Length
# notes: move the phone to the surface of the table
move_6 = Move(Geometry=geo_phone_components, Motion=vec2pt.Vector)  # -> Geometry, Transform
geo_phone_components_2 = Geometry(move_6.Geometry)
geo_phone_components_3 = Geometry(geo_phone_components_2)
# notes: rotate the phone to viewing position
phone_viewing_direction = Slider(0, range=0..360)
num_zero = Number(0)
item_2 = ListItem(List=geo_phone_components_3, Index="0", Wrap=True)
num_phone_viewing_direction = Number(num_zero)
pln_phone_origin_5 = Plane(item_2)
rotate = Rotate(Geometry=geo_phone_components_3, Angle=degrees(num_phone_viewing_direction), Plane=pln_phone_origin_5)  # -> Geometry, Transform
geo_phone_components_4 = Geometry(rotate.Geometry)
geo_phone_components_5 = Geometry(geo_phone_components_4)
item_3 = ListItem(List=geo_phone_components_5, Index="0", Wrap=True)
# notes: rotate the phone to viewing position "up/down"
phone_viewing_angle = Slider(77, range=0..360)
pln_phone_origin_6 = Plane(item_3)
deplane = DeconstructPlane(Plane=pln_phone_origin_6)  # -> Origin, XAxis, YAxis, ZAxis
num_phone_viewing_angle = Number(phone_viewing_angle)
line = LineSDL(Start=deplane.Origin, Direction=deplane.XAxis, Length=1)
rotax = RotateAxis(Geometry=geo_phone_components_5, Angle=degrees(num_phone_viewing_angle), Axis=line)  # -> Geometry, Transform
geo_phone_components_6 = Geometry(rotax.Geometry)
# notes: set the viewing orientation, "portrait/landscape"
portrait_landscape = ValueList({"portrait 0": "0", "landscape 90": "90", "portrait 180": "180", "landscape 270": "270"}, selected="landscape 90")
item_4 = ListItem(List=geo_phone_components_6, Index="0", Wrap=True)
item_5 = ListItem(List=geo_phone_components_6, Index="2", Wrap=True)
srf_phone_outline_surface_3 = Surface(item_5)
pln_phone_origin_7 = Plane(item_4)
num_phone_viewing_orientation = Number(portrait_landscape)
area = Area(Geometry=srf_phone_outline_surface_3)  # -> Area, Centroid
pl_origin = PlaneOrigin(Base=pln_phone_origin_7, Origin=area.Centroid)
rotate_2 = Rotate(Geometry=geo_phone_components_6, Angle=degrees(num_phone_viewing_orientation), Plane=pl_origin)  # -> Geometry, Transform
pln_phone_location_on_table_2 = Plane(pln_phone_location_on_table)
# notes: adjust phone location relative to table
phone_table_offset = Slider(-15, range=-50..50)
num_phone_viewing_orientation_2 = Number(num_phone_viewing_orientation)
geo_phone_components_7 = Geometry(rotate_2.Geometry)
Z_7 = UnitZ(Factor=phone_table_offset)
move_7 = Move(Geometry=geo_phone_components_7, Motion=Z_7)  # -> Geometry, Transform
geo_phone_components_8 = Geometry(move_7.Geometry)
produce_3d_stand = BooleanToggle(False)
geo_phone_components_9 = Geometry(geo_phone_components_8)
bool_display_3d_stand = Boolean(produce_3d_stand)
num_phone_viewing_orientation_3 = Number(num_phone_viewing_orientation_2)
pln_phone_location_on_table_3 = Plane(pln_phone_location_on_table)
geo_phone_components_10 = Geometry(geo_phone_components_9)
num_camera35mmlenslength_4 = Number(num_camera35mmlenslength_3)
geo_phone_components_11 = Geometry(geo_phone_components_9)
bool_display_3d_stand_2 = Boolean(bool_display_3d_stand)
filter_3 = StreamFilter(Gate=bool_display_3d_stand_2, Stream1=geo_phone_components_11)
bool_display_3d_stand_3 = Boolean(bool_display_3d_stand)
pln_phone_location_on_table_4 = Plane(pln_phone_location_on_table_2)
bool_display_3d_stand_4 = Boolean(bool_display_3d_stand)
geo_phone_components_12 = Geometry(geo_phone_components_9)
bool_display_3d_stand_5 = Boolean(bool_display_3d_stand)
filter_4 = StreamFilter(Gate=bool_display_3d_stand_3, Stream1=pln_phone_location_on_table_2)
filter_5 = StreamFilter(Gate=bool_display_3d_stand_5, Stream0=geo_phone_components_12)
filter_6 = StreamFilter(Gate=bool_display_3d_stand_4, Stream0=pln_phone_location_on_table_4)
support_spacing_ratio = Slider(0.19, range=0..0.5)
material_thickness = Slider(6, range=3..200)
screen_void_height = Slider(42, range=1..100)
screen_void_width = Slider(300, range=0..300)
projection_lip_distance = Slider(6, range=3..100)
projection_distance = Slider(180, range=100..300)
prism_offset = Slider(11, range=-300..300)
prism_height = Slider(113, range=0..300)
base_width = Slider(100, range=0..300)
base_depth = Slider(100, range=0..300)
base_offset_y = Slider(0, range=-100..100)
cross_brace_position_on_table = Slider(38, range=-50..50)
prism_depth = Slider(28, range=0..300)
cross_brace_height = Slider(80, range=-50..100)
# notes: Let us design a responsive solution given the design metris we have established given the student, activity, and context.  Here we may want to include metrics around perfomrance of the resulting form and fabrication processes.
pt_student_viewpoint_4 = Point(pt_student_viewpoint_3)
item_6 = ListItem(List=geo_phone_components_10, Index="3", Wrap=True)
item_7 = ListItem(List=geo_phone_components_10, Index="4", Wrap=True)
item_8 = ListItem(List=geo_phone_components_10, Index="6", Wrap=True)
item_9 = ListItem(List=geo_phone_components_10, Index="5", Wrap=True)
item_10 = ListItem(List=geo_phone_components_10, Index="7", Wrap=True)
pln_phone_location_on_table_5 = Plane(filter_6)
geo_phone_components_13 = Geometry(filter_5)
geo_phone_components_14 = Geometry(filter_3)
brep_phone_3 = Brep(item_6)
brep_phone_lens_3 = Brep(item_7)
pln_phone_lens_origin_7 = Plane(item_9)
num_camera35mmlenslength_5 = Number(num_camera35mmlenslength_4)
brep_phone_field_of_view_cone_3 = Brep(item_8)
crv_phone_screen_2 = Curve(item_10)
brep_student_activity_4 = Brep(brep_student_activity_3)
pln_phone_location_on_table_6 = Plane(filter_4)
brep_table_5 = Brep(brep_table_4)
item_11 = ListItem(List=geo_phone_components_13, Index="0", Wrap=True)
item_12 = ListItem(List=geo_phone_components_13, Index="2", Wrap=True)
item_13 = ListItem(List=geo_phone_components_13, Index="3", Wrap=True)
item_14 = ListItem(List=geo_phone_components_13, Index="7", Wrap=True)
item_15 = ListItem(List=geo_phone_components_13, Index="8", Wrap=True)
item_16 = ListItem(List=geo_phone_components_14, Index="0", Wrap=True)
item_17 = ListItem(List=geo_phone_components_14, Index="2", Wrap=True)
item_18 = ListItem(List=geo_phone_components_14, Index="3", Wrap=True)
item_19 = ListItem(List=geo_phone_components_14, Index="7", Wrap=True)
item_20 = ListItem(List=geo_phone_components_14, Index="8", Wrap=True)
brep_phone_field_of_view_cone_4 = Brep(brep_phone_field_of_view_cone_3)
crv_phone_screen_3 = Curve(crv_phone_screen_2)
brep_phone_4 = Brep(brep_phone_3)
crv_phone_screen_4 = Curve(crv_phone_screen_2)
srf_phone_outline_surface_4 = Surface(item_12)
pln_phone_origin_8 = Plane(item_11)
brep_tolerance_phone_2 = Brep(item_15)
shapein = ShapeInBrep(Brep=brep_phone_field_of_view_cone_3, Shape=brep_student_activity_4)
crv_phone_screen_5 = Curve(item_14)
volume = Volume(Geometry=brep_student_activity_4)  # -> Volume, Centroid
debrep = DeconstructBrep(Brep=brep_table_5)  # -> Faces, Edges, Vertices
brep_phone_5 = Brep(item_13)
srf_phone_outline_surface_5 = Surface(item_17)
shapein_2 = ShapeInBrep(Brep=brep_phone_4, Shape=brep_table_5)
pln_phone_origin_9 = Plane(item_16)
brep_tolerance_phone_3 = Brep(item_20)
crv_phone_screen_6 = Curve(item_19)
brep_phone_6 = Brep(item_18)
pln_phone_location_on_table_7 = Plane(pln_phone_location_on_table_5)
edges = BrepEdges(Brep=brep_phone_field_of_view_cone_3)  # -> Naked, Interior, NonManifold
xz_2 = XZPlane(Origin=volume.Centroid)
boundary_7 = BoundarySurfaces(Edges=crv_phone_screen_4)
bbx = BrepBrep(BrepA=debrep.Faces, BrepB=brep_phone_field_of_view_cone_4)  # -> Curves, Points
int_phone_in_table = Integer(shapein_2)
brep_phone_7 = Brep(brep_phone_5)
area_2 = Area(Geometry=brep_phone_4)  # -> Area, Centroid
volume_2 = Volume(Geometry=brep_phone_4)  # -> Volume, Centroid
dash = DashPattern(Curve=edges.Interior, Pattern="2,1")  # -> Dashes, Gaps
area_3 = Area(Geometry=boundary_7)  # -> Area, Centroid
crv_phone_screen_7 = Curve(crv_phone_screen_6)
brep_phone_8 = Brep(brep_phone_6)
panel_14 = Panel(shapein)
# notes: Let us visualize the camera view intersection with the table
crv_2 = Curve(flatten(bbx.Curves))
int_activity_in_view = Integer(shapein)
mesh_student_activity_4 = Mesh(mesh_student_activity_3)
material = CreateMaterial(
    Diffuse=ColourSwatch(SwatchColor=RGB(222, 233, 255)),
    Specular=RGB(255, 255, 255),
    Emission=RGB(0, 0, 0),
    Transparency=Slider(0.75, range=0..1),
    Shine=0)
material_2 = CreateMaterial(
    Diffuse=ColourSwatch(SwatchColor=RGB(0, 0, 0)),
    Specular=RGB(255, 255, 255),
    Emission=RGB(0, 0, 0),
    Transparency=Slider(0, range=0..1),
    Shine=0)
volume_3 = Volume(Geometry=brep_phone_7)  # -> Volume, Centroid
pt_phone_center_of_gravity = Point(volume_3.Centroid)
material_3 = CreateMaterial(
    Diffuse=ColourSwatch(SwatchColor=RGB(0, 90, 143)),
    Specular=RGB(255, 255, 255),
    Emission=RGB(0, 0, 0),
    Transparency=Slider(0, range=0..1),
    Shine=0)
project = Project(Geometry=pt_phone_center_of_gravity, Plane=pln_phone_location_on_table_7)  # -> Geometry, Transform
srf_cp = SurfaceClosestPoint(Point=area_3.Centroid, Surface=boundary_7)  # -> Point, UVPoint, Distance
volume_4 = Panel(area_2.Area)
pln_phone_location_on_table_8 = Plane(pln_phone_location_on_table_3)
volume_5 = Panel(volume_2.Volume)
pt_volume_centroid = Point(volume_2.Centroid)
pt_area_centroid = Point(area_2.Centroid)
eval_2 = Evaluate(
    F="if(x=0,inside,if(x=1,intersecting,outside))",
    x=int_activity_in_view,
    inside=ColourSwatch(SwatchColor=RGB(0, 255, 17)),
    intersecting=ColourSwatch(SwatchColor=RGB(221, 255, 0)),
    outside=ColourSwatch(SwatchColor=RGB(255, 0, 0)))
volume_6 = Volume(Geometry=brep_phone_8)  # -> Volume, Centroid
project_2 = Project(Geometry=volume_6.Centroid, Plane=pln_phone_location_on_table_6)  # -> Geometry, Transform
int_phone_in_table_2 = Integer(int_phone_in_table)
preview_2 = CustomPreview(Geometry=brep_phone_lens_3, Material=material_3)
evalsrf_2 = EvaluateSurface(Surface=boundary_7, Point=srf_cp.UVPoint)  # -> Point, Normal, UDirection, VDirection, Frame
preview_3 = CustomPreview(Geometry=brep_phone_field_of_view_cone_3, Material=material)  # disabled
offset_4 = OffsetCurve(Curve=crv_phone_screen_7, Distance=Slider(0, range=0..10), Corners=3)  # -> flatten(Curve)
preview_4 = CustomPreview(Geometry=dash.Dashes, Material=material_2)
medges_2 = MeshEdges(Mesh=mesh_student_activity_4)  # -> NakedEdges, InteriorEdges, NonManifoldEdges
screen_inset = Slider(5, range=3..100)
cone_base_radius = Slider(47, range=12..100)
cone_height = Slider(250, range=12..400)
inner_cone_wall_thickness = Slider(25, range=-50..50)
cone_truncate_height = Slider(63, range=12..200)
cone_base_y_offset = Slider(0, range=-50..50)
cone_base_x_offset = Slider(0, range=-50..50)
xy_5 = XYPlane(Origin=project_2.Geometry)
pln_phone_location_on_table_9 = Plane(pln_phone_location_on_table_6)
pl_origin_2 = PlaneOrigin(Base=pln_phone_location_on_table_7, Origin=project.Geometry)
pt_screen_center = Point(evalsrf_2.Point)
pln_phone_screen = Plane(evalsrf_2.Frame)
dist = Distance(PointA=project.Geometry, PointB=pt_phone_center_of_gravity)
pln_phone_center_of_gravity_on_table = Plane(pl_origin_2)
crv_phone_screen_8 = Curve(offset_4)
geo_to_preview_5 = Geometry(medges_2.InteriorEdges)
project_3 = Project(Geometry=pt_volume_centroid, Plane=pln_phone_location_on_table_8)  # -> Geometry, Transform
preview_5 = CustomPreview(Geometry=crv_2, Material=ColourSwatch(SwatchColor=RGB(255, 0, 0)))
boundary_8 = BoundarySurfaces(Edges=crv_phone_screen_8)
panel_15 = Panel(crv_phone_screen_8)
vec_2 = VectorXYZ(XComponent=cone_base_x_offset, YComponent=cone_base_y_offset, ZComponent=0)  # -> Vector, Length
area_4 = Area(Geometry=boundary_8)  # -> Area, Centroid
eval_3 = Evaluate(
    F="if(x=0,inside,if(x=1,intersecting,outside))",
    x=int_phone_in_table,
    inside=ColourSwatch(SwatchColor=RGB(255, 0, 0)),
    intersecting=ColourSwatch(SwatchColor=RGB(128, 208, 255)),
    outside=ColourSwatch(SwatchColor=RGB(0, 162, 255)))
material_4 = CreateMaterial(Diffuse=eval_3, Specular=RGB(255, 255, 255), Emission=RGB(0, 0, 0), Transparency=Slider(0, range=0..1), Shine=0)
preview_6 = CustomPreview(Geometry=brep_phone_3, Material=material_4)
ln = Line(StartPoint=project_3.Geometry, EndPoint=pt_volume_centroid)
num_material_thickness = Number(material_thickness)
subtraction = Subtraction(A=cone_base_radius, B=inner_cone_wall_thickness)
subtraction_2 = Subtraction(A=cone_height, B=inner_cone_wall_thickness)
move_8 = Move(Geometry=xy_5, Motion=vec_2.Vector)  # -> Geometry, Transform
srf_cp_2 = SurfaceClosestPoint(Point=area_4.Centroid, Surface=boundary_8)  # -> Point, UVPoint, Distance
brep_tolerance_phone_4 = Brep(brep_tolerance_phone_3)
deplane_2 = DeconstructPlane(Plane=pln_phone_center_of_gravity_on_table)  # -> Origin, XAxis, YAxis, ZAxis
cluster_14 = Cluster(num=base_width)
crv_phone_screen_9 = Curve(crv_phone_screen_5)
cluster_15 = Cluster(num=base_depth)
center_of_gravity_above_table = Panel(dist)
amp = Amplitude(Vector=deplane_2.YAxis, Amplitude=base_offset_y)
crv_center_of_gravity_axis = Curve(ln)
# notes: visual feedback on our design
# notes: Let us set a viewport view to match the view of our cellphone while in the stand
swatch = ColourSwatch(SwatchColor=RGB(255, 0, 0))
cone = Cone(Base=move_8.Geometry, Radius=cone_base_radius, Length=cone_height)  # -> Cone, Tip
pln_phone_center_of_gravity_on_table_2 = Plane(pln_phone_center_of_gravity_on_table)
evalsrf_3 = EvaluateSurface(Surface=boundary_8, Point=srf_cp_2.UVPoint)  # -> Point, Normal, UDirection, VDirection, Frame
move_9 = Move(Geometry=pln_phone_center_of_gravity_on_table, Motion=amp)  # -> Geometry, Transform
pln_phone_center_of_gravity_on_table_3 = Plane(move_9.Geometry)
cluster_16 = Cluster_2(geo_to_preview=geo_to_preview_5, col_preview_diffuse_color=eval_2, num_preview_transparency=Slider(1, range=0..1))
panel_16 = Panel(subtraction)
cone_2 = Cone(Base=move_8.Geometry, Radius=subtraction, Length=subtraction_2)  # -> Cone, Tip
example_todo = Panel("draw view frustum")
tag = TextTag3D(Location=xz_2, Text=panel_14, Size=Slider(120, range=1..120), Colour=eval_2, Justification=5)
preview_7 = CustomPreview(Geometry=crv_center_of_gravity_axis, Material=swatch)
panel_17 = Panel(crv_phone_screen_9)
boundary_9 = BoundarySurfaces(Edges=crv_phone_screen_9)
vec_3 = Vector(evalsrf_3.Normal)
num_base_depth = Number(base_depth)
cap_2 = CapHoles(Brep=cone.Cone)
cap_3 = CapHoles(Brep=cone_2.Cone)
num_material_thickness_2 = Number(num_material_thickness)
num_prism_height = Number(prism_height)
crv_phone_screen_10 = Curve(crv_phone_screen_8)
subtraction_3 = Subtraction(A=base_width, B=num_material_thickness)
amp_2 = Amplitude(Vector=deplane_2.YAxis, Amplitude=cross_brace_position_on_table)
vec_table_z = Vector(deplane_2.ZAxis)
amp_3 = Amplitude(Vector=vec_3, Amplitude=screen_inset)
amp_4 = Amplitude(Vector=vec_3, Amplitude=Slider(200, range=0..200))
area_5 = Area(Geometry=boundary_9)  # -> Area, Centroid
pln_phone_center_of_gravity_on_table_4 = Plane(pln_phone_center_of_gravity_on_table_3)
Z_8 = UnitZ(Factor=cone_truncate_height)
addition_2 = Addition(A=cone_base_radius, B="5")
sdiff = SolidDifference(BrepsA=cap_2, BrepsB=cap_3)
move_10 = Move(Geometry=pln_phone_center_of_gravity_on_table_2, Motion=amp_2)  # -> Geometry, Transform
srf_cp_3 = SurfaceClosestPoint(Point=area_5.Centroid, Surface=boundary_9)  # -> Point, UVPoint, Distance
crv_student_activity = Curve(cluster_16)
division_4 = Division(A=num_base_depth, B=Slider(4, range=1..4))
move_11 = Move(Geometry=crv_phone_screen_10, Motion=amp_3)  # -> Geometry, Transform
multiplication_5 = Multiplication(A=subtraction_3, B=support_spacing_ratio)
multiplication_6 = Multiplication(A=base_width, B=support_spacing_ratio)
multiplication_7 = Multiplication(A=multiplication_5, B="2.0")
cir_2 = Circle(Plane=move_8.Geometry, Radius=addition_2)
move_12 = Move(Geometry=move_11.Geometry, Motion=amp_4)  # -> Geometry, Transform
pln_phone_center_of_gravity_on_table_5 = Plane(pln_phone_center_of_gravity_on_table_3)
evalsrf_4 = EvaluateSurface(Surface=boundary_9, Point=srf_cp_3.UVPoint)  # -> Point, Normal, UDirection, VDirection, Frame
cluster_17 = Cluster(num=num_base_depth)
cluster_18 = Cluster(num=division_4)
cluster_19 = Cluster(num=num_material_thickness_2)
pln_cross_brace_on_table = Plane(move_10.Geometry)
num_material_thickness_3 = Number(num_material_thickness)
domain_base_depth = Domain(cluster_15)
domain_base_width = Domain(cluster_14)
addition_3 = Addition(A=num_material_thickness, B=multiplication_7)
extr_6 = Extrude(Base=cir_2, Direction=Z_8)
offset_5 = OffsetCurve(Curve=move_12.Geometry, Distance=Slider(200, range=0..200), Corners=1)  # -> flatten(Curve)
sdiff_2 = SolidDifference(BrepsA=sdiff, BrepsB=brep_tolerance_phone_4)
domain_base_width_2 = Domain(cluster_14)
cluster_20 = Cluster(num=screen_void_height)
cluster_21 = Cluster(num=screen_void_width)
vec_4 = Vector(evalsrf_4.Normal)
pln = Plane(evalsrf_4.Frame)
domain_material_thickness = Domain(cluster_19)
domain_base_depth_tab = Domain(cluster_18)
domain_base_depth_2 = Domain(cluster_17)
panel_18 = Panel(multiplication_6)
num_cross_brace_width = Number(base_width)
num_cross_brace_width_2 = Number(num_cross_brace_width)
division_5 = Division(A=num_cross_brace_width_2, B=Slider(4, range=1..4))
cluster_22 = Cluster(num=num_cross_brace_width_2)
cluster_23 = Cluster(num=division_5)
domain_section_surface_width = Domain(cluster_22)
domain_section_surface_width_2 = Domain(cluster_23)
int_phone_in_table_3 = Panel(int_phone_in_table_2)
panel_19 = Panel(multiplication_7)
rulesrf = RuledSurface(CurveA=crv_phone_screen_10, CurveB=move_11.Geometry)
int_activity_in_view_2 = Panel(int_activity_in_view)
rulesrf_2 = RuledSurface(CurveA=move_11.Geometry, CurveB=offset_5)
deplane_3 = DeconstructPlane(Plane=pln_phone_center_of_gravity_on_table_5)  # -> Origin, XAxis, YAxis, ZAxis
vec_table_z_2 = Vector(vec_table_z)
pln_phone_center_of_gravity_on_table_6 = Plane(pln_phone_center_of_gravity_on_table_4)
vec_table_y = Vector(deplane_3.YAxis)
vec_table_z_3 = Vector(deplane_3.ZAxis)
amp_5 = Amplitude(Vector=vec_4, Amplitude=projection_lip_distance)
amp_6 = Amplitude(Vector=vec_4, Amplitude=projection_distance)
cap_4 = CapHoles(Brep=rulesrf)
cap_5 = CapHoles(Brep=rulesrf_2)
pln_phone_lens_origin_8 = Plane(pln_phone_lens_origin_7)
amp_7 = Amplitude(Vector=deplane_2.XAxis, Amplitude=multiplication_5)
# cell phone stand base prism
amp_8 = Amplitude(Vector=vec_table_z_3, Amplitude=num_material_thickness_3)
rectangle_5 = Rectangle(Plane=pln_cross_brace_on_table, XSize=domain_section_surface_width, YSize=domain_material_thickness, Radius=0)  # -> Rectangle, Length
rectangle_6 = Rectangle(Plane=pln_cross_brace_on_table, XSize=domain_section_surface_width_2, YSize=domain_material_thickness, Radius=0)  # -> Rectangle, Length
# cell phone stand base
rectangle_7 = Rectangle(Plane=pln_phone_center_of_gravity_on_table_5, XSize=domain_base_width, YSize=domain_base_depth, Radius=0)  # -> Rectangle, Length
pln_phone_center_of_gravity_on_table_7 = Plane(pln_phone_center_of_gravity_on_table_5)
vec_material_thickness_in_z = Vector(amp_8)
deplane_4 = DeconstructPlane(Plane=pln_phone_lens_origin_8)  # -> Origin, XAxis, YAxis, ZAxis
merge_2 = Merge(Data1=cap_4, Data2=cap_5)
cluster_24 = Cluster(num=prism_depth)
vec_table_y_2 = Vector(vec_table_y)
boundary_10 = BoundarySurfaces(Edges=rectangle_6.Rectangle)
boundary_11 = BoundarySurfaces(Edges=rectangle_7.Rectangle)
boundary_12 = BoundarySurfaces(Edges=rectangle_5.Rectangle)
num_material_thickness_4 = Number(num_material_thickness_2)
sunion = SolidUnion(Breps=merge_2)
vec_table_z_4 = Vector(vec_table_z)
rectangle_8 = Rectangle(Plane=pln, XSize=domain_base_width_2, YSize=cluster_20, Radius=0)  # -> Rectangle, Length
move_13 = Move(Geometry=rectangle_8.Rectangle, Motion=amp_5)  # -> Geometry, Transform
amp_9 = Amplitude(Vector=vec_table_y_2, Amplitude=prism_offset)
domain_prism_depth = Domain(cluster_24)
subtraction_4 = Subtraction(A=cross_brace_height, B=num_material_thickness_4)
vec_table_z_5 = Vector(vec_table_z)
move_14 = Move(Geometry=rectangle_7.Rectangle, Motion=vec_material_thickness_in_z)  # -> Geometry, Transform
extr_7 = Extrude(Base=boundary_11, Direction=vec_material_thickness_in_z)
move_15 = Move(Geometry=move_13.Geometry, Motion=amp_6)  # -> Geometry, Transform
move_16 = Move(Geometry=pln_phone_center_of_gravity_on_table_7, Motion=vec_material_thickness_in_z)  # -> Geometry, Transform
amp_10 = Amplitude(Vector=vec_table_z_4, Amplitude=num_material_thickness_4)
num_prism_height_2 = Number(num_prism_height)
amp_11 = Amplitude(Vector=vec_3, Amplitude=Slider(100, range=12..100))
move_17 = Move(Geometry=move_16.Geometry, Motion=amp_9)  # -> Geometry, Transform
rectangle_9 = Rectangle(Plane=move_15.Geometry, XSize=domain_base_width_2, YSize=cluster_21, Radius=0)  # -> Rectangle, Length
extr_8 = Extrude(Base=crv_phone_screen_10, Direction=amp_11)
use_flared_screen_viewing_clearance = BooleanToggle(True)
amp_12 = Amplitude(Vector=vec_table_z_5, Amplitude=subtraction_4)
crv_phone_screen_11 = Curve(move_13.Geometry)
crv_phone_screen_12 = Curve(rectangle_9.Rectangle)
vec_table_z_6 = Vector(vec_table_z_2)
extr_9 = Extrude(Base=rectangle_8.Rectangle, Direction=amp_5)
move_18 = Move(Geometry=boundary_12, Motion=amp_10)  # -> Geometry, Transform
rectangle_10 = Rectangle(Plane=move_17.Geometry, XSize=domain_base_width, YSize=domain_prism_depth, Radius=0)  # -> Rectangle, Length
amp_13 = Amplitude(Vector=vec_table_z_5, Amplitude=num_prism_height_2)
cap_6 = CapHoles(Brep=extr_8)
cap_7 = CapHoles(Brep=extr_9)
amp_14 = Amplitude(Vector=vec_table_z_6, Amplitude=prism_height)
multiplication_8 = Multiplication(A=amp_12, B=".5")
merge_3 = Merge(Data1=crv_phone_screen_12, Data2=crv_phone_screen_11)
extr_10 = Extrude(Base=boundary_10, Direction=amp_10)
vec_material_thickness_in_z_2 = Vector(amp_8)
subtraction_5 = Subtraction(A=amp_13, B=multiplication_8)
move_19 = Move(Geometry=rectangle_10.Rectangle, Motion=amp_14)  # -> Geometry, Transform
loft = Loft(Curves=merge_3, Options={Adjust=False, Closed=False, LoftEnds=0, LoftSimp=0, LoftType=0, Rebuild=10, Refit=0.01})
merge_4 = Merge(Data1=move_14.Geometry, Data2=move_19.Geometry)
move_20 = Move(Geometry=move_18.Geometry, Motion=multiplication_8)  # -> Geometry, Transform
subtraction_6 = Subtraction(A=subtraction_5, B=amp_10)
extr_11 = Extrude(Base=move_18.Geometry, Direction=multiplication_8)
loft_2 = Loft(Curves=merge_4, Options={Adjust=False, Closed=False, LoftEnds=0, LoftSimp=0, LoftType=0, Rebuild=10, Refit=0.01})
cap_8 = CapHoles(Brep=loft)
rectangle_11 = Rectangle(Plane=pln_phone_center_of_gravity_on_table_6, XSize=domain_material_thickness, YSize=domain_base_depth_2, Radius=0)  # -> Rectangle, Length
rectangle_12 = Rectangle(Plane=pln_phone_center_of_gravity_on_table_6, XSize=domain_material_thickness, YSize=domain_base_depth_tab, Radius=0)  # -> Rectangle, Length
cap_9 = CapHoles(Brep=loft_2)
subtraction_7 = Subtraction(A=prism_height, B=num_material_thickness_2)
boundary_13 = BoundarySurfaces(Edges=rectangle_11.Rectangle)
boundary_14 = BoundarySurfaces(Edges=rectangle_12.Rectangle)
extr_12 = Extrude(Base=move_20.Geometry, Direction=subtraction_6)
merge_5 = Merge(Data1=cap_7, Data2=cap_8)
amp_15 = Amplitude(Vector=deplane_4.ZAxis, Amplitude=Slider(10000, range=1..10000))
extr_13 = Extrude(Base=move_20.Geometry, Direction=multiplication_8)
view_name = Panel("HumanView")
update_view = BooleanToggle(True)
pt_student_viewpoint_5 = Point(pt_student_viewpoint_3)
pt_screen_center_2 = Point(pt_screen_center)
Z_9 = UnitZ(Factor=1)
height = Slider(3, range=1..16)
camera35mmlenslength_2 = Slider(40, range=18..80)
view_height_pixels = Slider(340, range=16..800)
width = Slider(4, range=1..16)
reset_views = Button()
view_name_2 = Panel("PhoneCameraView")
merge_6 = Merge(Data1=extr_11, Data2=extr_10)
update_view_2 = BooleanToggle(True)
update_view_3 = BooleanToggle(True)
height_2 = Slider(16, range=1..16)
view_height_pixels_2 = Slider(600, range=16..800)
width_2 = Slider(9, range=1..16)
num_phone_viewing_orientation_4 = Number(num_phone_viewing_orientation_3)
move_21 = Move(Geometry=deplane_4.Origin, Motion=amp_15)  # -> Geometry, Transform
amp_16 = Amplitude(Vector=vec_table_z_2, Amplitude=subtraction_7)
brep_cross_brace_slot = Brep(extr_12)
move_22 = Move(Geometry=boundary_13, Motion=vec_material_thickness_in_z_2)  # -> Geometry, Transform
brep = Brep(extr_13)
sunion_2 = SolidUnion(Breps=merge_6)
boundary_15 = BoundarySurfaces(Edges=move_22.Geometry)
filter_7 = StreamFilter(Gate=use_flared_screen_viewing_clearance, Stream0=cap_6, Stream1=sunion)
division_6 = Division(A=width, B=height)
sunion_3 = SolidUnion(Breps=merge_5)
division_7 = Division(A=width_2, B=height_2)
brep_2 = Brep(sunion_2)
bool_reset_views = Boolean(reset_views)
bool_reset_views_2 = Boolean(reset_views)
bool_reset_views_3 = Boolean(reset_views)
num_camera35mmlenslength_6 = Number(camera35mmlenslength_2)
extr_14 = Extrude(Base=boundary_15, Direction=amp_16)
or = GateOr(A=bool_reset_views_2, B=update_view_3)
or_2 = GateOr(A=bool_reset_views_3, B=update_view)
num_camera35mmlenslength_7 = Number(num_camera35mmlenslength_5)
brep_tolerance_phone_5 = Brep(brep_tolerance_phone_2)
sint = SolidIntersection(BrepsA=extr_14, BrepsB=cap_9)
pt_phone_target = Point(move_21.Geometry)
vec_camera_up = Vector(deplane_4.YAxis)
pln_phone_location_on_table_10 = Plane(pln_phone_location_on_table_9)
pt_phone_lens = Point(deplane_4.Origin)
cap_10 = CapHoles(Brep=extr_6)
sdiff_3 = SolidDifference(BrepsA=sdiff_2, BrepsB=filter_7)
view_guides = ValueList({"use phone screen plane": true, "use view normal plane": false}, selected="use phone screen plane")
display_student_view_guides = BooleanToggle(True)
crv_phone_screen_13 = Curve(crv_phone_screen_3)
pt_student_viewpoint_6 = Point(pt_student_viewpoint_4)
pln_phone_screen_2 = Plane(pln_phone_screen)
extr_15 = Extrude(Base=boundary_14, Direction=vec_material_thickness_in_z_2)
floating_viewport = CSharpScript(
    view_name=view_name,
    view_reset=or_2,
    view_location=pt_student_viewpoint_5,
    view_target=pt_screen_center_2,
    view_up=Z_9,
    Camera35mmLensLength=num_camera35mmlenslength_6,
    view_height=view_height_pixels,
    view_aspectratio=division_6,
    view_orientation_degrees="0")  # -> out, result; inputs view_name: String, view_reset: Boolean, view_location: Point3d, view_target: Point3d, view_up: Vector3d, Camera35mmLensLength: Double, view_height: Double, view_aspectratio: Double, view_orientation_degrees: Double
# ---------- floating_viewport: C# usings ----------
using Rhino.Display;
using System.Drawing;
# ---------- floating_viewport: C# ----------
    result = "";
    try
    {
      if(view_reset)
      {
        if(RhinoDocument.Views.Find(view_name, false) == null)
        {
          result += " Find:" + view_name + ": NOT FOUND. LAUNCHING VIEWPORT.";
          DefinedViewportProjection projection = DefinedViewportProjection.Perspective;
          Rectangle rect = new Rectangle(0, 0, 100, 100);
          RhinoView newView = RhinoDoc.ActiveDoc.Views.Add(view_name, projection, rect, true);
          doc.Views.ActiveView = newView;
        }
        int viewportWidth = 25;
        int viewportHeight = 25;

        if(view_orientation_degrees == 0)
        {
          viewportWidth = (int) (view_aspectratio * view_height);
          viewportHeight = (int) (view_height);
        }
        else if(view_orientation_degrees == 90)
        {
          viewportHeight = (int) (view_aspectratio * view_height);
          viewportWidth = (int) (view_height);
        }
        else if(view_orientation_degrees == 180)
        {
          viewportWidth = (int) (view_aspectratio * view_height);
          viewportHeight = (int) (view_height);
        }
        else if(view_orientation_degrees == 270)
        {
          viewportHeight = (int) (view_aspectratio * view_height);
          viewportWidth = (int) (view_height);
        }

        doc.Views.ActiveView = RhinoDocument.Views.Find(view_name, false);

        result += " Find:" + view_name + ": FOUND";
        result += " Name:" + doc.Views.ActiveView.ActiveViewport.Name + " viewportWidth: " + viewportWidth + " viewportHeight:" + viewportHeight;

        vp = Rhino.RhinoDoc.ActiveDoc.Views.ActiveView.ActiveViewport;
        vp.Size = new Size(viewportWidth, viewportHeight);
        Rhino.RhinoDoc.ActiveDoc.Views.ActiveView.Size = vp.Size;
        //set new camera
        vp.Camera35mmLensLength = Camera35mmLensLength;
        vp.SetCameraLocations(view_target, view_location);
        //vp.CameraUp = view_up;
        //vp.SetClippingPlanes(clipping);
        Rhino.RhinoDoc.ActiveDoc.Views.ActiveView.Redraw();
        RhinoDocument.Views.Redraw();
      }
      else
      {
        result = "reset == false";
      }
    }
    catch (Exception ex)
    {
      result = "An error occurred: " + ex.Message;
    }
# ---------- floating_viewport: C# additional code ----------
  Rhino.Display.RhinoViewport vp;
# ---------- end floating_viewport ----------
# notes: Here we have a function in C# that uses the Rhinocommon API to set the view to a camera.
floating_viewport_2 = CSharpScript(
    view_name=view_name_2,
    view_reset=or,
    view_location=pt_phone_lens,
    view_target=pt_phone_target,
    view_up=vec_camera_up,
    Camera35mmLensLength=num_camera35mmlenslength_7,
    view_height=view_height_pixels_2,
    view_aspectratio=division_7,
    view_orientation_degrees=num_phone_viewing_orientation_4)  # -> out, result; inputs view_name: String, view_reset: Boolean, view_location: Point3d, view_target: Point3d, view_up: Vector3d, Camera35mmLensLength: Double, view_height: Double, view_aspectratio: Double, view_orientation_degrees: Double; same code as floating_viewport
sint_2 = SolidIntersection(BrepsA=sdiff_3, BrepsB=cap_10)
brep_3 = Brep(sint_2)
ln_2 = Line(StartPoint=pln_phone_screen_2, EndPoint=pt_student_viewpoint_6)
brep_4 = Brep(sint)
vec2pt_2 = Vector2Pt(PointA=pt_student_viewpoint_6, PointB=pln_phone_screen_2, Unitize=False)  # -> Vector, Length
divdist = DivideDistance(Curve=ln_2, Distance=Slider(25, range=1..300))  # -> Points, Tangents, Parameters
panel_20 = Panel(floating_viewport.result)
merge_7 = Merge(Data1=brep_4, Data2=extr_15)
panel_21 = Panel(floating_viewport_2.result)
volume_7 = Volume(Geometry=brep_3)  # -> Volume, Centroid
pl = PlaneNormal(Origin=pt_student_viewpoint_6, ZAxis=vec2pt_2.Vector)
extr_16 = ExtrudePoint(Base=crv_phone_screen_13, Point=pt_student_viewpoint_6)
sunion_4 = SolidUnion(Breps=merge_7)
cap_11 = CapHoles(Brep=extr_16)
filter_8 = StreamFilter(Gate=view_guides, Stream0=pl, Stream1=pln_phone_screen_2)
rectangle_width_mm = Slider(1000, range=0..12000)
rectangle_length_mm = Slider(1000, range=0..12000)
dist_2 = Distance(PointA=volume_7.Centroid, PointB=pln_phone_location_on_table_10)
pl_origin_3 = PlaneOrigin(Base=filter_8, Origin=divdist.Points)
rev_3 = Reverse(Vector=amp_7)
brep_5 = Brep(sunion_4)
pln_2 = Plane(pl_origin_3)
sort = SortList(Keys=dist_2, ValuesA=brep_3)  # -> Keys, ValuesA
num_rectangle_length = Number(rectangle_length_mm)
num_rectangle_width = Number(rectangle_width_mm)
brep_tolerance_phone_6 = Brep(brep_tolerance_phone_5)
item_21 = ListItem(List=sort.ValuesA, Index=0, Wrap=True)
move_23 = Move(Geometry=brep_5, Motion=rev_3)  # -> Geometry, Transform
move_24 = Move(Geometry=brep_5, Motion=amp_7)  # -> Geometry, Transform
len = Length(Curve=ln_2)
dist_3 = Distance(PointA=pln_2, PointB=pt_student_viewpoint_6)
cluster_25 = Cluster(num=num_rectangle_length)
cluster_26 = Cluster(num=num_rectangle_width)
division_8 = Division(A=dist_3, B=len)
brep_6 = Brep(sunion_3)
sdiff_4 = SolidDifference(BrepsA=move_23.Geometry, BrepsB=brep_tolerance_phone_6)
brep_7 = Brep(extr_7)
sdiff_5 = SolidDifference(BrepsA=move_24.Geometry, BrepsB=brep_tolerance_phone_6)
domain_table_length_3 = Domain(cluster_25)
sint_3 = SolidIntersection(BrepsA=brep_tolerance_phone_6, BrepsB=move_23.Geometry)
domain_table_width_3 = Domain(cluster_26)
sint_4 = SolidIntersection(BrepsA=brep_tolerance_phone_6, BrepsB=move_24.Geometry)
gradient = Gradient(LowerLimit=0, UpperLimit=1, Parameter=division_8, stops=[0: RGB(0, 255, 0), 0.5: RGB(255, 255, 0), 1: RGB(255, 0, 0)])
preview_8 = CustomPreview(Geometry=item_21, Material=ColourSwatch(SwatchColor=RGB(230, 230, 230)))
lng = ListLength(List=sint_3)
lng_2 = ListLength(List=sint_4)
brep_cross_brace_slot_2 = Brep(brep_cross_brace_slot)
sdiff_6 = SolidDifference(BrepsA=sdiff_4, BrepsB=brep_6)
sdiff_7 = SolidDifference(BrepsA=sdiff_5, BrepsB=brep_6)
brep_8 = Brep(cap_11)
rectangle_13 = Rectangle(Plane=pln_2, XSize=domain_table_width_3, YSize=domain_table_length_3, Radius=0)  # -> Rectangle, Length
sdiff_8 = SolidDifference(BrepsA=sdiff_6, BrepsB=brep_cross_brace_slot_2)
sdiff_9 = SolidDifference(BrepsA=sdiff_7, BrepsB=brep_cross_brace_slot_2)
larger = LargerThan(FirstNumber=lng, SecondNumber="0")  # -> LargerThan, OrEqualTo
larger_2 = LargerThan(FirstNumber=lng_2, SecondNumber="0")  # -> LargerThan, OrEqualTo
brep_9 = Brep(brep)
brep_10 = Brep(brep_2)
fmerge = MergeFaces(Brep=sdiff_8)  # -> Breps, Before, After
fmerge_2 = MergeFaces(Brep=sdiff_9)  # -> Breps, Before, After
bbx_2 = BrepBrep(BrepA=brep_8, BrepB=rectangle_13.Rectangle)  # -> flatten(Curves), Points
bool = Boolean(larger.LargerThan)
bool_2 = Boolean(larger_2.LargerThan)
sdiff_10 = SolidDifference(BrepsA=brep_10, BrepsB=sdiff_9)
and = GateAnd(A=bool, B=bool_2)
sdiff_11 = SolidDifference(BrepsA=sdiff_10, BrepsB=sdiff_8)
sdiff_12 = SolidDifference(BrepsA=brep_7, BrepsB=fmerge.Breps)
col = Colour(graft(gradient))
panel_22 = Panel("""1
3""")
brep_stand_a = Brep(fmerge.Breps)
brep_stand_b = Brep(fmerge_2.Breps)
material_5 = CreateMaterial(Diffuse=col, Specular=RGB(255, 255, 255), Emission=RGB(0, 0, 0), Transparency=0, Shine=0)
dash_2 = DashPattern(Curve=bbx_2.Curves, Pattern=panel_22)  # -> simplify(Dashes), Gaps
merge_8 = Merge(Data1=sdiff_11, Data2=brep_9)
sdiff_13 = SolidDifference(BrepsA=sdiff_12, BrepsB=fmerge_2.Breps)
sunion_5 = SolidUnion(Breps=merge_8)
fmerge_3 = MergeFaces(Brep=sunion_5)  # -> Breps, Before, After
sdiff_14 = SolidDifference(BrepsA=sdiff_13, BrepsB=brep_10)
filter_9 = StreamFilter(Gate=display_student_view_guides, Stream1=material_5)
filter_10 = StreamFilter(Gate=display_student_view_guides, Stream1=dash_2.Dashes)
brep_cross_brace = Brep(fmerge_3.Breps)
eval_4 = Evaluate(
    F="if(x,intersecting,outside)",
    x=and,
    intersecting=ColourSwatch(SwatchColor=RGB(189, 237, 255)),
    outside=ColourSwatch(SwatchColor=RGB(255, 0, 0)))
preview_9 = CustomPreview(Geometry=filter_10, Material=filter_9)
brep_stand_a_2 = Brep(brep_stand_a)
brep_stand_b_2 = Brep(brep_stand_b)
brep_cross_brace_2 = Brep(brep_cross_brace)
brep_11 = Brep(sdiff_14)
debrep_2 = DeconstructBrep(Brep=brep_11)  # -> Faces, Edges, Vertices
debrep_3 = DeconstructBrep(Brep=brep_stand_b_2)  # -> Faces, Edges, Vertices
debrep_4 = DeconstructBrep(Brep=brep_cross_brace_2)  # -> Faces, Edges, Vertices
debrep_5 = DeconstructBrep(Brep=brep_stand_a_2)  # -> Faces, Edges, Vertices
area_6 = Area(Geometry=debrep_2.Faces)  # -> Area, Centroid
area_7 = Area(Geometry=debrep_3.Faces)  # -> Area, Centroid
area_8 = Area(Geometry=debrep_4.Faces)  # -> Area, Centroid
area_9 = Area(Geometry=debrep_5.Faces)  # -> Area, Centroid
pdecon_3 = Deconstruct(Point=area_6.Centroid)  # -> XComponent, YComponent, ZComponent
pdecon_4 = Deconstruct(Point=area_7.Centroid)  # -> XComponent, YComponent, ZComponent
pdecon_5 = Deconstruct(Point=area_8.Centroid)  # -> XComponent, YComponent, ZComponent
pdecon_6 = Deconstruct(Point=area_9.Centroid)  # -> XComponent, YComponent, ZComponent
sort_2 = SortList(Keys=pdecon_3.ZComponent, ValuesA=debrep_2.Faces)  # -> Keys, ValuesA
sort_3 = SortList(Keys=pdecon_4.XComponent, ValuesA=debrep_3.Faces)  # -> Keys, ValuesA
item_22 = ListItem(List=sort_2.ValuesA, Index=0, Wrap=True)
sort_4 = SortList(Keys=pdecon_5.YComponent, ValuesA=debrep_4.Faces)  # -> Keys, ValuesA
sort_5 = SortList(Keys=pdecon_6.XComponent, ValuesA=debrep_5.Faces)  # -> Keys, ValuesA
vec_material_thickness_in_z_3 = Vector(vec_material_thickness_in_z_2)
srf_base_plate = Surface(item_22)
item_23 = ListItem(List=sort_3.ValuesA, Index=0, Wrap=True)
item_24 = ListItem(List=sort_4.ValuesA, Index=0, Wrap=True)
item_25 = ListItem(List=sort_5.ValuesA, Index=0, Wrap=True)
extr_17 = Extrude(Base=srf_base_plate, Direction=vec_material_thickness_in_z_3)
brep_stand_a_3 = Brep(brep_stand_a)
brep_stand_b_3 = Brep(brep_stand_b)
brep_cross_brace_3 = Brep(brep_cross_brace)
brep_base_plate = Brep(flatten(extr_17))
cluster_27 = Cluster_7(brep_list=brep_stand_a_3)
cluster_28 = Cluster_7(brep_list=brep_stand_b_3)
cluster_29 = Cluster_7(brep_list=brep_cross_brace_3)
sint_5 = SolidIntersection(BrepsA=brep_base_plate, BrepsB=brep_stand_a_3)
sint_6 = SolidIntersection(BrepsA=brep_base_plate, BrepsB=brep_stand_b_3)
sint_7 = SolidIntersection(BrepsA=brep_base_plate, BrepsB=brep_cross_brace_3)
sint_8 = SolidIntersection(BrepsA=brep_stand_a_3, BrepsB=brep_stand_b_3)
sint_9 = SolidIntersection(BrepsA=brep_stand_a_3, BrepsB=brep_cross_brace_3)
sint_10 = SolidIntersection(BrepsA=brep_stand_b_3, BrepsB=brep_cross_brace_3)
lng_3 = ListLength(List=sint_5)
lng_4 = ListLength(List=sint_6)
lng_5 = ListLength(List=sint_7)
lng_6 = ListLength(List=sint_8)
lng_7 = ListLength(List=sint_10)
lng_8 = ListLength(List=sint_9)
or_3 = GateOr(A=cluster_27, B=cluster_28, C=cluster_29)
# Note that, in its current configuration, it is possible that no parts intersetc AND it is impossible to assemble. So visually inspect, or write something that would test for this.
merge_9 = Merge(Data1=lng_3, Data2=lng_4, Data3=lng_5, Data4=lng_6, Data5=lng_8, Data6=lng_7)
ma = MassAddition(Input=merge_9)  # -> Result, PartialResults
are_there_unexpected_parts = Panel(or_3)
int_zero = Integer(0)
larger_3 = LargerThan(FirstNumber=ma.Result, SecondNumber=int_zero)  # -> LargerThan, OrEqualTo
or_4 = GateOr(A=larger_3.LargerThan, B=or_3)
are_parts_intersecting = Panel(larger_3.LargerThan)
srf_base_plate_2 = Surface(srf_base_plate)
srf = Surface(item_25)
srf_2 = Surface(item_23)
srf_3 = Surface(item_24)
bool_there_are_problems = Boolean(or_4)
bool_there_are_problems_2 = Boolean(bool_there_are_problems)
merge_10 = Merge(Data1=srf_base_plate_2, Data2=srf, Data3=srf_2, Data4=srf_3)
surface_centroid_spacing = Slider(144, range=0..300)
filter_11 = StreamFilter(Gate=bool_there_are_problems_2, Stream0=merge_10)
filter_12 = StreamFilter(Gate=bool_there_are_problems_2, Stream0=merge_10)
eval_5 = Evaluate(
    F="if(x,problems,notproblems)",
    x=bool_there_are_problems,
    problems=ColourSwatch(SwatchColor=RGB(255, 0, 0)),
    notproblems=ColourSwatch(SwatchColor=RGB(189, 237, 255)))
xy_6 = XYPlane(Origin=Point(0, 0, 0))
col_2 = Colour(eval_5)
lng_9 = ListLength(List=filter_11)
X = UnitX(Factor=surface_centroid_spacing)
merge_parts = Merge(Data1=brep_base_plate, Data2=brep_stand_a_3, Data3=brep_stand_b_3, Data4=brep_cross_brace_3)
preview_10 = CustomPreview(Geometry=brep_base_plate, Material=col_2)
preview_11 = CustomPreview(Geometry=brep_stand_a_3, Material=col_2)
preview_12 = CustomPreview(Geometry=brep_stand_b_3, Material=col_2)
preview_13 = CustomPreview(Geometry=brep_cross_brace_3, Material=col_2)
arrlinear = LinearArray(Geometry=xy_6, Direction=X, Count=lng_9)  # -> Geometry, Transform
move_off_model = Slider(5000, range=18..100000)
cluster_30 = Cluster_4(pln_destination=arrlinear.Geometry, srf=filter_12)  # -> srf_at_destination_2, pln_average_2
X_2 = UnitX(Factor=move_off_model)
pt_7 = Point(cluster_30.pln_average_2)
move_25 = Move(Geometry=cluster_30.srf_at_destination_2, Motion=X_2)  # -> Geometry, Transform
move_26 = Move(Geometry=pt_7, Motion=X_2)  # -> Geometry, Transform
pt_surfaces_centroid = Point(move_26.Geometry)
srf_coplanar_faces = Surface(move_25.Geometry)
sheet_width = Slider(12, range=0..48)
sheet_height = Slider(12, range=0..48)
part_spacing = Slider(0.25, range=0..1)
attempts_at_packing = Slider(1, range=0..48)
# This will slow things down,but helps with drawings. activate once otherdecisions have been made.
use_opennest = BooleanToggle(False)
bool_use_opennest = Boolean(use_opennest)
num_in_to_mm = Number(expr("x*25.4", sheet_width))
num_in_to_mm_2 = Number(expr("x*25.4", sheet_height))
num_in_to_mm_3 = Number(expr("x*25.4", part_spacing))
pt_surfaces_centroid_2 = Point(pt_surfaces_centroid)
srf_coplanar_faces_2 = Surface(srf_coplanar_faces)
rectangle_sheet = Rectangle(Plane=pt_surfaces_centroid_2, XSize=num_in_to_mm, YSize=num_in_to_mm_2, Radius=0)  # -> Rectangle, Length
opennest = OpenNest(
    Sheets=rectangle_sheet.Rectangle,
    Geo=srf_coplanar_faces_2,
    Spacing=num_in_to_mm_3,
    Placement=1,
    Tolerance=0.1,
    Rotations=4,
    Iterations=attempts_at_packing,
    Seed=1,
    Reset=True,
    Run=False)  # -> Sheets, Geo, ID, Transform, IDS
filter_13 = StreamFilter(Gate=bool_use_opennest, Stream1=opennest.Sheets)
filter_14 = StreamFilter(Gate=bool_use_opennest, Stream0=srf_coplanar_faces_2, Stream1=opennest.Geo)
crv_sheets = Curve(filter_13)
boundary_16 = BoundarySurfaces(Edges=crv_sheets)
preview_14 = CustomPreview(Geometry=crv_sheets, Material=ColourSwatch(SwatchColor=RGB(0, 0, 0)))
area_10 = Area(Geometry=boundary_16)  # -> Area, Centroid
edges_2 = BrepEdges(Brep=filter_14)  # -> flatten(Naked), Interior, NonManifold
edges_3 = BrepEdges(Brep=srf_coplanar_faces_2)  # -> flatten(Naked), Interior, NonManifold
area_11 = Area(Geometry=srf_coplanar_faces_2)  # -> Area, Centroid
avr = Average(Input=area_10.Centroid)
dim_offset_distance_mm = Slider(20, range=0..120)
dim_size_mm = Slider(20, range=0..120)
explode = Explode(Curve=crv_sheets, Recursive=True)  # -> Segments, Vertices
avr_2 = Average(Input=area_11.Centroid)
join = JoinCurves(Curves=edges_2.Naked, Preserve=False)
join_2 = JoinCurves(Curves=edges_3.Naked, Preserve=False)
pt_center_of_sheets = Point(avr)
end = EndPoints(Curve=explode.Segments)  # -> Start, End
len_2 = Length(Curve=explode.Segments)
text_at_end = Panel("\"")
text_formatting = Panel("{0:0.00}")
crv_bake_me_2 = Curve(join)
crv_bake_me_1 = Curve(join_2)
num_mm_to_in = Number(expr("x/25.4", len_2))
filter_15 = StreamFilter(Gate=bool_use_opennest, Stream0=avr_2, Stream1=pt_center_of_sheets)
offset_6 = OffsetCurve(Curve=explode.Segments, Distance=dim_offset_distance_mm, Corners=1)  # -> flatten(Curve)
srf_coplanar_faces_3 = Surface(filter_14)
format = Format(Format=text_formatting, Culture=127, Data0=num_mm_to_in)
cluster_31 = Cluster_6(srf_coplanar_faces=srf_coplanar_faces_3)  # -> srf_coplanar_faces_5, crv_coplanar_drawings_3, pt_all_vertices_in_drawing_3, num_drawing_length_2, num_faces_total_area_4, pt_faces_centroid_3, crv_bounding_rectangle_3, num_bounding_rect_area_3, crv_convex_hull_2, num_packing_ratio_2
concat_6 = Concatenate(FragmentA=format, FragmentB=text_at_end)
lineardim = LinearDimension(Line=offset_6, PointA=end.Start, PointB=end.End, Text=concat_6, Size=dim_size_mm)
move_off_model_2 = Slider(60000, range=18..100000)
xy_7 = XYPlane(Origin=Point(0, 0, 0))
num_bounding_rect_area = Number(cluster_31.num_bounding_rect_area_3)
pt_all_vertices_in_drawing = Point(cluster_31.pt_all_vertices_in_drawing_3)
crv_bounding_rectangle = Curve(cluster_31.crv_bounding_rectangle_3)
crv_coplanar_drawings = Curve(cluster_31.crv_coplanar_drawings_3)
num_drawing_length = Number(cluster_31.num_drawing_length_2)
num_packing_ratio = Number(cluster_31.num_packing_ratio_2)
srf_coplanar_faces_4 = Surface(cluster_31.srf_coplanar_faces_5)
pt_faces_centroid = Point(cluster_31.pt_faces_centroid_3)
pt_center_of_sheets_2 = Point(filter_15)
crv_convex_hull = Curve(cluster_31.crv_convex_hull_2)
panel_23 = Panel(num_packing_ratio)
panel_24 = Panel(num_bounding_rect_area)
X_3 = UnitX(Factor=move_off_model_2)
pln_3 = Plane(xy_7)
pln_phone_location_on_table_11 = Plane(pln_phone_location_on_table_10)
num_mm2_to_in2 = Number(expr("x/645.16", panel_24))
brep_3d_stand = Brep(item_21)
move_27 = Move(Geometry=pln_3, Motion=X_3)  # -> Geometry, Transform
panel_25 = Panel(num_mm2_to_in2)
orient = Orient(Geometry=brep_3d_stand, Source=pln_phone_location_on_table_11, Target=move_27.Geometry)  # -> Geometry, Transform
gradient_2 = Gradient(LowerLimit=0, UpperLimit=1, Parameter=panel_23, stops=[0: RGB(0, 128, 0), 0.5: RGB(176, 176, 0), 1: RGB(255, 0, 0)])
dash_pattern = Panel("""5
5""")
brep_3d_stand_2 = Brep(orient.Geometry)
dash_3 = DashPattern(Curve=crv_bounding_rectangle, Pattern=dash_pattern)  # -> simplify(Dashes), Gaps
camera35mmlenslength_3 = Slider(53, range=18..80)
volume_8 = Volume(Geometry=brep_3d_stand_2)  # -> Volume, Centroid
preview_15 = CustomPreview(Geometry=brep_3d_stand_2, Material=ColourSwatch(SwatchColor=RGB(230, 230, 230)))
preview_16 = CustomPreview(Geometry=crv_coplanar_drawings, Material=ColourSwatch(SwatchColor=RGB(255, 0, 0)))
preview_17 = CustomPreview(Geometry=dash_3.Dashes, Material=gradient_2)
preview_18 = CustomPreview(Geometry=srf_coplanar_faces_4, Material=ColourSwatch(SwatchColor=RGB(145, 222, 255)))
pt_faces_centroid_2 = Point(volume_8.Centroid)
Z_10 = UnitZ(Factor=camera35mmlenslength_3)
height_3 = Slider(3, range=1..16)
camera35mmlenslength_4 = Slider(59, range=18..80)
view_height_pixels_3 = Slider(340, range=16..800)
width_3 = Slider(4, range=1..16)
pt_surfaces_centroid_3 = Point(pt_faces_centroid_2)
update_view_4 = BooleanToggle(True)
view_name_3 = Panel("DrawingsView")
move_28 = Move(Geometry=pt_faces_centroid_2, Motion=Z_10)  # -> Geometry, Transform
Y = UnitY(Factor=1)
pt_view_location_offset = Slider(45, range=18..80)
bool_reset_views_4 = Boolean(bool_reset_views)
pt_center_of_sheets_3 = Point(pt_center_of_sheets_2)
division_9 = Division(A=width_3, B=height_3)
num_camera35mmlenslength_8 = Number(camera35mmlenslength_4)
or_5 = GateOr(A=bool_reset_views_4, B=update_view_4)
Z_11 = UnitZ(Factor=pt_view_location_offset)
pt_view_target = Point(pt_center_of_sheets_3)
panel_26 = Panel(move_28.Geometry)
camera35mmlenslength_5 = Slider(59, range=18..80)
view_height_pixels_4 = Slider(340, range=16..800)
width_4 = Slider(4, range=1..16)
height_4 = Slider(3, range=1..16)
view_name_4 = Panel("DrawingsView")
update_view_5 = BooleanToggle(True)
bool_reset_views_5 = Boolean(bool_reset_views)
move_29 = Move(Geometry=pt_view_target, Motion=Z_11)  # -> Geometry, Transform
pt_view_target_2 = Point(pt_view_target)
Y_2 = UnitY(Factor=1)
floating_viewport_3 = CSharpScript(
    view_name=view_name_3,
    view_reset=or_5,
    view_location=move_28.Geometry,
    view_target=pt_surfaces_centroid_3,
    view_up=Y,
    Camera35mmLensLength=num_camera35mmlenslength_8,
    view_height=view_height_pixels_3,
    view_aspectratio=division_9,
    view_orientation_degrees="0")  # -> out, result; inputs view_name: String, view_reset: Boolean, view_location: Point3d, view_target: Point3d, view_up: Vector3d, Camera35mmLensLength: Double, view_height: Double, view_aspectratio: Double, view_orientation_degrees: Double; same code as floating_viewport
division_10 = Division(A=width_4, B=height_4)
num_camera35mmlenslength_9 = Number(camera35mmlenslength_5)
or_6 = GateOr(A=bool_reset_views_5, B=update_view_5)
panel_27 = Panel(floating_viewport_3.result)
projection = Panel("Top")
floating_viewport_4 = CSharpScript(
    view_name=view_name_4,
    view_reset=or_6,
    view_location=move_29.Geometry,
    view_target=pt_view_target_2,
    view_projection=projection,
    view_up=Y_2,
    Camera35mmLensLength=num_camera35mmlenslength_9,
    view_height=view_height_pixels_4,
    view_aspectratio=division_10,
    view_orientation_degrees="0")  # -> out, result; inputs view_name: String, view_reset: Boolean, view_location: Point3d, view_target: Point3d, view_projection: String, view_up: Vector3d, Camera35mmLensLength: Double, view_height: Double, view_aspectratio: Double, view_orientation_degrees: Double
# ---------- floating_viewport_4: C# usings ----------
using Rhino.Display;


using System.Drawing;
# ---------- floating_viewport_4: C# ----------
    result = "";
    try
    {
      if(view_reset)
      {
        Rectangle rect = new Rectangle(0, 0, 100, 100);
        if(RhinoDocument.Views.Find(view_name, false) == null)
        {
          result += " Find:" + view_name + ": NOT FOUND. LAUNCHING VIEWPORT.";
          DefinedViewportProjection projection;
          if(view_projection == "Top")
          {
            projection = DefinedViewportProjection.Top;
          }
          else
          {
            projection = DefinedViewportProjection.Perspective;
          }

          RhinoView newView = RhinoDoc.ActiveDoc.Views.Add(view_name, projection, rect, true);
          doc.Views.ActiveView = newView;
        }
        int viewportWidth = 25;
        int viewportHeight = 25;

        if(view_orientation_degrees == 0)
        {
          viewportWidth = (int) (view_aspectratio * view_height);
          viewportHeight = (int) (view_height);
        }
        else if(view_orientation_degrees == 90)
        {
          viewportHeight = (int) (view_aspectratio * view_height);
          viewportWidth = (int) (view_height);
        }
        else if(view_orientation_degrees == 180)
        {
          viewportWidth = (int) (view_aspectratio * view_height);
          viewportHeight = (int) (view_height);
        }
        else if(view_orientation_degrees == 270)
        {
          viewportHeight = (int) (view_aspectratio * view_height);
          viewportWidth = (int) (view_height);
        }

        doc.Views.ActiveView = RhinoDocument.Views.Find(view_name, false);

        result += " Find:" + view_name + ": FOUND";
        result += " Name:" + doc.Views.ActiveView.ActiveViewport.Name + " viewportWidth: " + viewportWidth + " viewportHeight:" + viewportHeight;

        vp = Rhino.RhinoDoc.ActiveDoc.Views.ActiveView.ActiveViewport;
        vp.Size = new Size(viewportWidth, viewportHeight);
        Rhino.RhinoDoc.ActiveDoc.Views.ActiveView.Size = vp.Size;
        //set new camera
        vp.Camera35mmLensLength = Camera35mmLensLength;
        vp.SetCameraLocations(view_target, view_location);
        vp.CameraUp = view_up;
        //vp.SetClippingPlanes(clipping);


        //Point3d min = new Point3d(rect.X, rect.Y, 0);
        //Point3d max = new Point3d(rect.X + rect.Width, rect.Y + rect.Height, 0);
        //BoundingBox bbox = new BoundingBox(min, max);

        //vp.ZoomBoundingBox(bbox);

        Rhino.RhinoDoc.ActiveDoc.Views.ActiveView.Redraw();
        RhinoDocument.Views.Redraw();
      }
      else
      {
        result = "reset == false";
      }
    }
    catch (Exception ex)
    {
      result = "An error occurred: " + ex.Message;
    }
# ---------- floating_viewport_4: C# additional code ----------
  Rhino.Display.RhinoViewport vp;
# ---------- end floating_viewport_4 ----------
panel_28 = Panel(floating_viewport_4.result)

# ==== cluster Cluster
num = ClusterInput()
num_2 = Number(num)
division = Division(A=num_2, B="2.0")
neg = Negative(Value=division)
dom = ConstructDomain(DomainStart=division, DomainEnd=neg)
domain = Domain(dom)
domain_2 = ClusterOutput(domain)

# ==== cluster Cluster_2
geo_to_preview = ClusterInput()
col_preview_diffuse_color = ClusterInput()
num_preview_transparency = ClusterInput()
geo_to_preview_2 = Geometry(geo_to_preview)
col_preview_diffuse_color_2 = Colour(col_preview_diffuse_color)
num_preview_transparency_2 = Number(num_preview_transparency)
material = CreateMaterial(
    Diffuse=col_preview_diffuse_color_2,
    Specular=RGB(255, 255, 255),
    Emission=RGB(0, 0, 0),
    Transparency=num_preview_transparency_2,
    Shine=0)
preview = CustomPreview(Geometry=geo_to_preview_2, Material=material)
geo_to_preview_3 = ClusterOutput(geo_to_preview_2)

# ==== cluster Cluster_3
num_camera35mmlenslength = ClusterInput()
# notes: these values were determined empirically. this equation may require adjestment depending on your setup.
num_camera35mmlenslength_2 = Number(num_camera35mmlenslength)
num = Number("2/30")
num_2 = Number("40")
multiplication = Multiplication(A=num_2, B=num)
division = Division(A=multiplication, B=num_camera35mmlenslength_2)
panel = Panel(division)
panel_2 = Panel(multiplication)
num_fov = Number(division)
num_fov_2 = ClusterOutput(num_fov)

# ==== cluster Cluster_4
srf = ClusterInput()
pln_destination = ClusterInput()
srf_2 = Surface(srf)
pln_destination_2 = Plane(pln_destination)
area = Area(Geometry=srf_2)  # -> Area, Centroid
planar = IsPlanar(Surface=srf_2, Interior=True)  # -> Planar, Plane
srf_3 = Surface(srf_2)
deplane = DeconstructPlane(Plane=pln_destination_2)  # -> Origin, XAxis, YAxis, ZAxis
pl_origin = PlaneOrigin(Base=planar.Plane, Origin=area.Centroid)
avr = Average(Input=deplane.Origin)
orient = Orient(Geometry=srf_3, Source=pl_origin, Target=pln_destination_2)  # -> Geometry, Transform
pl = ConstructPlane(Origin=avr, XAxis=Vector(1, 0, 0), YAxis=Vector(0, 1, 0))
srf_at_destination = Surface(orient.Geometry)
pln_average = Plane(pl)
srf_at_destination_2 = ClusterOutput(srf_at_destination)
pln_average_2 = ClusterOutput(pln_average)

# ==== cluster Cluster_6
srf_coplanar_faces = ClusterInput()
srf_coplanar_faces_2 = Surface(srf_coplanar_faces)
srf_coplanar_faces_3 = Surface(srf_coplanar_faces_2)
edges = BrepEdges(Brep=srf_coplanar_faces_2)  # -> Naked, Interior, NonManifold
join = JoinCurves(Curves=edges.Naked, Preserve=False)  # -> flatten(Curves)
crv_coplanar_drawings = Curve(join)
area = Area(Geometry=srf_coplanar_faces_3)  # -> Area, Centroid
debrep = DeconstructBrep(Brep=crv_coplanar_drawings)  # -> Faces, Edges, Vertices
avr = Average(Input=area.Centroid)
ma = MassAddition(Input=area.Area)  # -> Result, PartialResults
num_faces_total_area = Number(ma.Result)
pt_all_vertices_in_drawing = Point(flatten(debrep.Vertices))
pt_faces_centroid = Point(avr)
hull = ConvexHull(Points=pt_all_vertices_in_drawing, Plane=PlaneXY(0, 0, 0))  # -> Hull, HullZ, Indices
pdecon = Deconstruct(Point=pt_all_vertices_in_drawing)  # -> XComponent, YComponent, ZComponent
cluster = Cluster_5(num_list=pdecon.YComponent)  # -> num_smallest_2, num_biggest_2
cluster_2 = Cluster_5(num_list=pdecon.XComponent)  # -> num_smallest_2, num_biggest_2
cluster_3 = Cluster_5(num_list=pdecon.ZComponent)  # -> num_smallest_2, num_biggest_2
pt = ConstructPoint(XCoordinate=cluster_2.num_smallest_2, YCoordinate=cluster.num_smallest_2, ZCoordinate=cluster_3.num_smallest_2)
pt_2 = ConstructPoint(XCoordinate=cluster_2.num_biggest_2, YCoordinate=cluster.num_biggest_2, ZCoordinate=cluster_3.num_biggest_2)
len = Length(Curve=crv_coplanar_drawings)
ma_2 = MassAddition(Input=len)  # -> Result, PartialResults
rec_2pt = Rectangle2Pt(Plane=PlaneXY(0, 0, 0), PointA=pt, PointB=pt_2, Radius=0)  # -> Rectangle, Length
crv_bounding_rectangle = Curve(rec_2pt.Rectangle)
boundary = BoundarySurfaces(Edges=crv_bounding_rectangle)
area_2 = Area(Geometry=boundary)  # -> Area, Centroid
num_bounding_rect_area = Number(area_2.Area)
num_faces_total_area_2 = Number(num_faces_total_area)
division = Division(A=num_faces_total_area_2, B=num_bounding_rect_area)
num_bounding_rect_area_2 = Number(num_bounding_rect_area)
pt_all_vertices_in_drawing_2 = Point(pt_all_vertices_in_drawing)
crv_bounding_rectangle_2 = Curve(crv_bounding_rectangle)
num_packing_ratio = Number(flatten(division))
crv_coplanar_drawings_2 = Curve(crv_coplanar_drawings)
srf_coplanar_faces_4 = Surface(flatten(srf_coplanar_faces_3))
num_drawing_length = Number(ma_2.Result)
num_faces_total_area_3 = Number(num_faces_total_area_2)
pt_faces_centroid_2 = Point(pt_faces_centroid)
crv_convex_hull = Curve(hull.Hull)
srf_coplanar_faces_5 = ClusterOutput(srf_coplanar_faces_4)
crv_coplanar_drawings_3 = ClusterOutput(crv_coplanar_drawings_2)
pt_all_vertices_in_drawing_3 = ClusterOutput(pt_all_vertices_in_drawing_2)
num_drawing_length_2 = ClusterOutput(num_drawing_length)
num_faces_total_area_4 = ClusterOutput(num_faces_total_area_3)
pt_faces_centroid_3 = ClusterOutput(pt_faces_centroid_2)
crv_bounding_rectangle_3 = ClusterOutput(crv_bounding_rectangle_2)
num_bounding_rect_area_3 = ClusterOutput(num_bounding_rect_area_2)
crv_convex_hull_2 = ClusterOutput(crv_convex_hull)
num_packing_ratio_2 = ClusterOutput(num_packing_ratio)

# ==== cluster Cluster_7
brep_list = ClusterInput()
brep_list_2 = Brep(brep_list)
lng = ListLength(List=brep_list_2)
int_one = Integer(1)
larger = LargerThan(FirstNumber=lng, SecondNumber=int_one)  # -> LargerThan, OrEqualTo
bool_more_than_one_brep = Boolean(larger.LargerThan)
bool_more_than_one_brep_2 = ClusterOutput(bool_more_than_one_brep)

# ==== cluster Cluster_5
num_list = ClusterInput()
num_list_2 = Number(num_list)
sort = SortList(Keys=num_list_2)  # -> Keys, ValuesA
num_list_sorted = Number(sort.Keys)
lng = ListLength(List=num_list_sorted)
int_one = Integer(1)
subtraction = Subtraction(A=lng, B=int_one)
item = ListItem(List=num_list_sorted, Index=subtraction, Wrap=False)
item_2 = ListItem(List=num_list_sorted, Index=0, Wrap=False)
num_smallest = Number(item_2)
num_biggest = Number(item)
num_smallest_2 = ClusterOutput(num_smallest)
num_biggest_2 = ClusterOutput(num_biggest)
