# Grasshopper definition facialCushion_test_01.gh (Grasshopper 1.0.7)

# ---- group: BaseGeometry / VariableSet 1
depth_y = Slider(28.3, range=20..30)
width_x = Slider(70, range=1..150)
number_slider = Slider(12.1, range=1..14)
depth_y_2 = Slider(-8, range=-30..0)
X = Panel("0")
height_z = Panel("24")

# ---- group: FaceGeometry / FaceMicroAdjustments
Z = Slider(0, range=-15..15)
X_2 = Slider(0.24, range=-15..15)

# ---- group: Eyes / EyeSettings
ipd_2_l = Slider(36, range=24..38)
ipd_2_r = Slider(35, range=24..38)
eyeoffset_r = Slider(4, range=3..12)

# ----
eyeoffset_l = Slider(7, range=3..12)

# ---- group: BaseGeometry / Z Value
number = Number(height_z)
multiplication = Multiplication(A=number, B="2")
subtraction = Subtraction(A="0", B=multiplication)
vector_xyz = VectorXYZ(XComponent="0", YComponent="0", ZComponent=subtraction)  # -> Vector, Length

# ---- group: BaseGeometry
_0 = Panel("0")
subtraction_2 = Subtraction(A=depth_y, B=number_slider)
subtraction_3 = Subtraction(A=_0, B=depth_y)
construct_point = ConstructPoint(XCoordinate=X, YCoordinate=subtraction_2, ZCoordinate=height_z)
construct_point_2 = ConstructPoint(XCoordinate=width_x, YCoordinate=depth_y_2, ZCoordinate=height_z)
yz_plane = YZPlane(Origin=Point(0, 0, 0))
construct_point_3 = ConstructPoint(XCoordinate=width_x, YCoordinate=subtraction_3, ZCoordinate=height_z)
point = Point(construct_point)
point_2 = Point(construct_point_2)
mirror = Mirror(Geometry=point_2, Plane=yz_plane)  # -> Geometry, Transform
point_3 = Point(construct_point_3)
mirror_2 = Mirror(Geometry=point_3, Plane=yz_plane)  # -> Geometry, Transform
point_4 = Point(mirror.Geometry)
point_5 = Point(mirror_2.Geometry)
interpolate = Interpolate(Vertices=[point_2, point, point_4], Degree=3, Periodic=False, KnotStyle=1)  # -> Curve, Length, Domain
line = Line(StartPoint=point_3, EndPoint=point_5)
line_2 = Line(line)
curve = Curve(interpolate.Curve)
loft = Loft(Curves=[line_2, curve], Options={Adjust=False, Closed=False, LoftEnds=0, LoftSimp=0, LoftType=0, Rebuild=10, Refit=0.01})
extrude = Extrude(Base=loft, Direction=vector_xyz.Vector)

# ---- group: FaceGeometry
vector_xyz_2 = VectorXYZ(XComponent="0", YComponent="0", ZComponent="0")  # -> Vector, Length
import_3dm = Import3DM(File="D:\OneDrive\Mingzhou_Design\Projects\2023-2024 Mdes\XR Goggle\Implement\face.3dm", Layer="*", Name="*")
vector_xyz_3 = VectorXYZ(XComponent="0", YComponent="0", ZComponent=Z)  # -> Vector, Length
vector_xyz_4 = VectorXYZ(XComponent=X_2, YComponent="0", ZComponent="0")  # -> Vector, Length
point_6 = Point(vector_xyz_2.Vector)
line_3 = Line(StartPoint=point_6, EndPoint=vector_xyz_4.Vector)
line_4 = Line(StartPoint=point_6, EndPoint=vector_xyz_3.Vector)
move = Move(Geometry=import_3dm, Motion=line_3)  # -> Geometry, Transform
panel = Panel([line_4, line_3])
move_2 = Move(Geometry=move.Geometry, Motion=line_4)  # -> Geometry, Transform

# ---- group: Eyes
subtraction_4 = Subtraction(A="0", B=ipd_2_l)
addition = Addition(A=ipd_2_r, B=eyeoffset_r)
subtraction_5 = Subtraction(A=subtraction_4, B=eyeoffset_l)
vector_xyz_5 = VectorXYZ(XComponent=addition, YComponent="0", ZComponent="0")  # -> Vector, Length
vector_xyz_6 = VectorXYZ(XComponent="0", YComponent="0", ZComponent="0")  # -> Vector, Length
vector_xyz_7 = VectorXYZ(XComponent=subtraction_5, YComponent="0", ZComponent="0")  # -> Vector, Length
center_box = CenterBox(Base=PlaneXY(0, 0, 0), X="22", Y="40", Z="16")
point_7 = Point(vector_xyz_7.Vector)
point_8 = Point(vector_xyz_6.Vector)
point_9 = Point(vector_xyz_5.Vector)
point_10 = Point(vector_xyz_6.Vector)
line_5 = Line(StartPoint=point_8, EndPoint=point_7)
line_6 = Line(StartPoint=point_10, EndPoint=point_9)
move_3 = Move(Geometry=center_box, Motion=line_5)  # -> Geometry, Transform
move_4 = Move(Geometry=center_box, Motion=line_6)  # -> Geometry, Transform

# ----
fillet = Fillet()

# ---- group: MeshSubtract
solid_difference = SolidDifference(BrepsA=extrude, BrepsB=[move_4.Geometry, move_3.Geometry])
mesh_brep = MeshBrep(
    Brep=solid_difference,
    Settings={GridMaxCount=0, GridMinCount=16, JaggedSeams=False, MaxEdgeLength=0, MinEdgeLength=0.0001, MinTolerance=0, Refine=True, RefineAngle=0, RelativeTolerance=0.65, SimplePlanes=True, Tolerance=0})
mesh_difference = MeshDifference(MeshesA=mesh_brep, MeshesB=move_2.Geometry)

# ----
custom_preview = CustomPreview(
    Geometry=mesh_difference,
    Material={diffuse=RGB(221, 160, 221), emission=RGB(66, 48, 66), shine=0.5, specular=RGB(255, 255, 255), transparency=0})
