# Grasshopper definition facialCushion_test_02.gh (Grasshopper 1.0.7)

# ---- group: BaseGeometry / VariableSet 1
depth_y = Slider(28.3, range=20..30)
width_x = Slider(66, range=1..150)
foreheadcurve = Slider(12.4, range=1..14)
depth_y_2 = Slider(-8, range=-30..0)
X = Panel("0")
height_z = Panel("24")

# ---- group: EyeSettings
ipd_2_l = Slider(36, range=24..38)
ipd_2_r = Slider(35, range=24..38)

# ---- group: FaceGeometry / FaceMicroAdjustments
Z = Slider(0, range=-15..15)
X_2 = Slider(0.24, range=-15..15)

# ---- group: BaseGeometry / Z Value
number = Number(height_z)
multiplication = Multiplication(A=number, B="2")
subtraction = Subtraction(A="0", B=multiplication)
vector_xyz = VectorXYZ(XComponent="0", YComponent="0", ZComponent=subtraction)  # -> Vector, Length

# ---- group: BaseGeometry
_0 = Panel("0")
subtraction_2 = Subtraction(A=depth_y, B=foreheadcurve)
subtraction_3 = Subtraction(A=_0, B=depth_y)
construct_point = ConstructPoint(XCoordinate=X, YCoordinate=subtraction_2, ZCoordinate=height_z)
construct_point_2 = ConstructPoint(XCoordinate=width_x, YCoordinate=depth_y_2, ZCoordinate=height_z)
yz_plane = YZPlane(Origin=Point(0, 0, 0))
construct_point_3 = ConstructPoint(XCoordinate=width_x, YCoordinate=subtraction_3, ZCoordinate=height_z)
point = Point(construct_point)
point_2 = Point(construct_point_2)
mirror = Mirror(Geometry=point_2, Plane=yz_plane)  # -> Geometry, Transform
point_3 = Point(construct_point_3)
mirror_2 = Mirror(Geometry=point_3, Plane=yz_plane)  # -> Geometry, Transform
point_4 = Point(mirror.Geometry)
point_5 = Point(mirror_2.Geometry)
interpolate = Interpolate(Vertices=[point_2, point, point_4], Degree=3, Periodic=False, KnotStyle=1)  # -> Curve, Length, Domain
line = Line(StartPoint=point_3, EndPoint=point_5)
line_2 = Line(line)
curve = Curve(interpolate.Curve)
loft = Loft(Curves=[line_2, curve], Options={Adjust=False, Closed=False, LoftEnds=0, LoftSimp=0, LoftType=0, Rebuild=10, Refit=0.01})
extrude = Extrude(Base=loft, Direction=vector_xyz.Vector)

# ---- group: FaceGeometry
vector_xyz_2 = VectorXYZ(XComponent="0", YComponent="0", ZComponent="0")  # -> Vector, Length
vector_xyz_3 = VectorXYZ(XComponent="0", YComponent="0", ZComponent=Z)  # -> Vector, Length
import_3dm = Import3DM(File="D:\OneDrive\Mingzhou_Design\Projects\2023-2024 Mdes\XR Goggle\Implement\face.3dm", Layer="*", Name="*")
vector_xyz_4 = VectorXYZ(XComponent=X_2, YComponent="0", ZComponent="0")  # -> Vector, Length
point_6 = Point(vector_xyz_2.Vector)
line_3 = Line(StartPoint=point_6, EndPoint=vector_xyz_4.Vector)
line_4 = Line(StartPoint=point_6, EndPoint=vector_xyz_3.Vector)
move = Move(Geometry=import_3dm, Motion=line_3)  # -> Geometry, Transform
panel = Panel([line_4, line_3])
move_2 = Move(Geometry=move.Geometry, Motion=line_4)  # -> Geometry, Transform

# ----
# Notes: Adjust this slider if there's any uncut geometries
number_slider = Slider(-100, range=-100..-20)

xz_plane = XZPlane(Origin=Point(0, 0, 0))
ipd_2_l_2 = Number(ipd_2_l)
division = Division(A="30", B="2")
division_2 = Division(A="44", B="2")
rectangle = Rectangle(Plane=xz_plane, XSize="44", YSize="30", Radius="4")  # -> Rectangle, Length
ipd_2_r_2 = Number(ipd_2_r)
subtraction_4 = Subtraction(A="0", B=ipd_2_l_2)
number_2 = Number(division)
number_3 = Number(division_2)
subtraction_5 = Subtraction(A="0", B=number_2)
subtraction_6 = Subtraction(A=ipd_2_r_2, B=number_3)
subtraction_7 = Subtraction(A=subtraction_4, B=number_3)
vector_xyz_5 = VectorXYZ(XComponent=subtraction_6, YComponent="0", ZComponent=subtraction_5)  # -> Vector, Length
vector_xyz_6 = VectorXYZ(XComponent=subtraction_7, YComponent="0", ZComponent=subtraction_5)  # -> Vector, Length
number_4 = Number(depth_y)
move_3 = Move(Geometry=rectangle.Rectangle, Motion=vector_xyz_5.Vector)  # -> Geometry, Transform
move_4 = Move(Geometry=rectangle.Rectangle, Motion=vector_xyz_6.Vector)  # -> Geometry, Transform
subtraction_8 = Subtraction(A="0", B=number_4)
number_5 = Number(depth_y)
vector_xyz_7 = VectorXYZ(XComponent=0, YComponent=subtraction_8, ZComponent=0)  # -> Vector, Length
boundary_surfaces = BoundarySurfaces(Edges=move_3.Geometry)
vector_xyz_8 = VectorXYZ(XComponent="0", YComponent=number_5, ZComponent="0")  # -> Vector, Length
boundary_surfaces_2 = BoundarySurfaces(Edges=move_4.Geometry)
vector_xyz_9 = VectorXYZ(XComponent="0", YComponent=number_slider, ZComponent="0")  # -> Vector, Length
move_5 = Move(Geometry=[boundary_surfaces_2, boundary_surfaces], Motion=vector_xyz_8.Vector)  # -> Geometry, Transform
extrude_2 = Extrude(Base=move_5.Geometry, Direction=vector_xyz_9.Vector)

# ---- group: MeshSubtract
solid_difference = SolidDifference(BrepsA=extrude, BrepsB=extrude_2)
mesh_brep = MeshBrep(
    Brep=solid_difference,
    Settings={GridMaxCount=0, GridMinCount=16, JaggedSeams=False, MaxEdgeLength=0, MinEdgeLength=0.0001, MinTolerance=0, Refine=True, RefineAngle=0, RelativeTolerance=0.65, SimplePlanes=True, Tolerance=0})
mesh_difference = MeshDifference(MeshesA=mesh_brep, MeshesB=move_2.Geometry)

# ----
custom_preview = CustomPreview(
    Geometry=mesh_difference,
    Material={diffuse=RGB(221, 160, 221), emission=RGB(66, 48, 66), shine=0.5, specular=RGB(255, 255, 255), transparency=0})
