# Grasshopper definition facialCushion_test_03.gh (Grasshopper 1.0.7)

# ---- group: BaseGeometry / VariableSet 1
width_x = Slider(66, range=1..150)
depth_y = Slider(28.3, range=20..30)
foreheadcurve = Slider(12.3, range=1..14)
depth_y_2 = Slider(-8, range=-30..0)
X = Panel("0")
height_z = Panel("24")

# ---- group: EyeSettings
ipd_2_l = Slider(36, range=24..38)
ipd_2_r = Slider(35, range=24..38)

# ----
# Notes: Adjust this slider if there's any uncut geometries
number_slider = Slider(-100, range=-100..-20)

width_offset = Slider(11.5, range=0..50)

xz_plane = XZPlane(Origin=Point(0, 0, 0))
ipd_2_l_2 = Number(ipd_2_l)
division = Division(A="36", B="2")
division_2 = Division(A="50", B="2")
rectangle = Rectangle(Plane=xz_plane, XSize="50", YSize="36", Radius="4")  # -> Rectangle, Length
ipd_2_r_2 = Number(ipd_2_r)
subtraction = Subtraction(A="0", B=ipd_2_l_2)
number = Number(division)
number_2 = Number(division_2)
subtraction_2 = Subtraction(A=ipd_2_r_2, B=number_2)
subtraction_3 = Subtraction(A="0", B=number)
subtraction_4 = Subtraction(A=subtraction, B=number_2)
vector_xyz = VectorXYZ(XComponent=subtraction_2, YComponent="0", ZComponent=subtraction_3)  # -> Vector, Length
vector_xyz_2 = VectorXYZ(XComponent=subtraction_4, YComponent="0", ZComponent=subtraction_3)  # -> Vector, Length
number_3 = Number(depth_y)
move = Move(Geometry=rectangle.Rectangle, Motion=vector_xyz.Vector)  # -> Geometry, Transform
move_2 = Move(Geometry=rectangle.Rectangle, Motion=vector_xyz_2.Vector)  # -> Geometry, Transform
subtraction_5 = Subtraction(A="0", B=number_3)
number_4 = Number(depth_y)
vector_xyz_3 = VectorXYZ(XComponent=0, YComponent=subtraction_5, ZComponent=0)  # -> Vector, Length
boundary_surfaces = BoundarySurfaces(Edges=move.Geometry)
vector_xyz_4 = VectorXYZ(XComponent="0", YComponent=number_4, ZComponent="0")  # -> Vector, Length
boundary_surfaces_2 = BoundarySurfaces(Edges=move_2.Geometry)
vector_xyz_5 = VectorXYZ(XComponent="0", YComponent=number_slider, ZComponent="0")  # -> Vector, Length
move_3 = Move(Geometry=[boundary_surfaces_2, boundary_surfaces], Motion=vector_xyz_4.Vector)  # -> Geometry, Transform
extrude = Extrude(Base=move_3.Geometry, Direction=vector_xyz_5.Vector)

addition = Addition(A=width_offset, B=width_x)

# ---- group: FaceGeometry / FaceMicroAdjustments
Z = Slider(0, range=-15..15)
X_2 = Slider(0.24, range=-15..15)

# ---- group: FaceGeometry
vector_xyz_6 = VectorXYZ(XComponent="0", YComponent="0", ZComponent="0")  # -> Vector, Length
import_3dm = Import3DM(File="D:\OneDrive\Mingzhou_Design\Projects\2023-2024 Mdes\XR Goggle\Implement\face.3dm", Layer="*", Name="*")
vector_xyz_7 = VectorXYZ(XComponent="0", YComponent="0", ZComponent=Z)  # -> Vector, Length
vector_xyz_8 = VectorXYZ(XComponent=X_2, YComponent="0", ZComponent="0")  # -> Vector, Length
point = Point(vector_xyz_6.Vector)
line = Line(StartPoint=point, EndPoint=vector_xyz_8.Vector)
line_2 = Line(StartPoint=point, EndPoint=vector_xyz_7.Vector)
move_4 = Move(Geometry=import_3dm, Motion=line)  # -> Geometry, Transform
panel = Panel([line_2, line])
move_5 = Move(Geometry=move_4.Geometry, Motion=line_2)  # -> Geometry, Transform

# ---- group: BaseGeometry / Z Value
number_5 = Number(height_z)
multiplication = Multiplication(A=number_5, B="2")
subtraction_6 = Subtraction(A="0", B=multiplication)
vector_xyz_9 = VectorXYZ(XComponent="0", YComponent="0", ZComponent=subtraction_6)  # -> Vector, Length

# ----
colour = Colour(ColourSwatch(SwatchColor=RGB(48, 200, 227)))
create_material = CreateMaterial(Diffuse=colour, Specular=RGB(255, 255, 255), Emission=RGB(0, 0, 0), Transparency=0, Shine=0)

# ---- group: BaseGeometry
_0 = Panel("0")
subtraction_7 = Subtraction(A=depth_y, B=foreheadcurve)
subtraction_8 = Subtraction(A=_0, B=depth_y)
construct_point = ConstructPoint(XCoordinate=width_x, YCoordinate=depth_y_2, ZCoordinate=height_z)
construct_point_2 = ConstructPoint(XCoordinate=X, YCoordinate=subtraction_7, ZCoordinate=height_z)
yz_plane = YZPlane(Origin=Point(0, 0, 0))
construct_point_3 = ConstructPoint(XCoordinate=addition, YCoordinate=subtraction_8, ZCoordinate=height_z)
point_2 = Point(construct_point_2)
point_3 = Point(construct_point)
mirror = Mirror(Geometry=point_3, Plane=yz_plane)  # -> Geometry, Transform
point_4 = Point(construct_point_3)
mirror_2 = Mirror(Geometry=point_4, Plane=yz_plane)  # -> Geometry, Transform
point_5 = Point(mirror_2.Geometry)
point_6 = Point(mirror.Geometry)
interpolate = Interpolate(Vertices=[point_3, point_2, point_6], Degree=3, Periodic=False, KnotStyle=1)  # -> Curve, Length, Domain
curve = Curve(interpolate.Curve)

# ----
point_7 = Point(point_2)
deconstruct_vector = DeconstructVector(Vector=point_7)  # -> XComponent, YComponent, ZComponent
number_6 = Number(height_z)
subtraction_9 = Subtraction(A="0", B=number_6)
construct_point_4 = ConstructPoint(XCoordinate=deconstruct_vector.XComponent, YCoordinate=deconstruct_vector.YComponent, ZCoordinate=subtraction_9)
construct_point_5 = ConstructPoint(XCoordinate="0", YCoordinate=Slider(2, range=-12..29), ZCoordinate="0")
interpolate_2 = Interpolate(Vertices=[point_7, construct_point_5, construct_point_4], Degree=3, Periodic=False, KnotStyle=1)  # -> Curve, Length, Domain
line_3 = Line(StartPoint=point_7, EndPoint=construct_point_4)
boundary_surfaces_3 = BoundarySurfaces(Edges=[interpolate_2.Curve, line_3])
number_7 = Number(width_x)
vector_xyz_10 = VectorXYZ(XComponent=number_7, YComponent=0, ZComponent=0)  # -> Vector, Length
yz_plane_2 = YZPlane(Origin=Point(0, 0, 0))
extrude_2 = Extrude(Base=boundary_surfaces_3, Direction=vector_xyz_10.Vector)
mirror_3 = Mirror(Geometry=extrude_2, Plane=yz_plane_2)  # -> Geometry, Transform

deconstruct = Deconstruct(Point=point_5)  # -> XComponent, YComponent, ZComponent
addition_2 = Addition(A=Slider(4.3, range=0..20), B=deconstruct.XComponent)
construct_point_6 = ConstructPoint(XCoordinate=addition_2, YCoordinate=deconstruct.YComponent, ZCoordinate=deconstruct.ZComponent)

# ---- group: BaseGeometry (continued)
line_4 = Line(StartPoint=point_4, EndPoint=construct_point_6)
line_5 = Line(line_4)
loft = Loft(Curves=[line_5, curve], Options={Adjust=False, Closed=False, LoftEnds=0, LoftSimp=0, LoftType=0, Rebuild=10, Refit=0.01})
extrude_3 = Extrude(Base=loft, Direction=vector_xyz_9.Vector)

# ----
solid_difference = SolidDifference(BrepsA=extrude_3, BrepsB=[extrude_2, mirror_3.Geometry])

# ---- group: MeshSubtract
solid_difference_2 = SolidDifference(BrepsA=solid_difference, BrepsB=extrude)
mesh_brep = MeshBrep(
    Brep=solid_difference_2,
    Settings={GridMaxCount=0, GridMinCount=16, JaggedSeams=False, MaxEdgeLength=0, MinEdgeLength=0.0001, MinTolerance=0, Refine=True, RefineAngle=0, RelativeTolerance=0.65, SimplePlanes=True, Tolerance=0})
mesh_difference = MeshDifference(MeshesA=mesh_brep, MeshesB=move_5.Geometry)

# ----
custom_preview = CustomPreview(Geometry=mesh_difference, Material=create_material)
